# Grasshopper definition 230729a.gh (Grasshopper 1.0.7)

c_script = CSharpScript(Reference=["C:\Windows\WinSxS\amd64_system.net.http_b03f5f7f11d50a3a_4.0.15805.0_none_49364fe7559e5a05\System.Net.Http.dll", "C:\Windows\WinSxS\msil_hyperv-ux-ui-newtonsoftjson_31bf3856ad364e35_10.0.19041.1_none_f501448ecc10dc94\Newtonsoft.Json.dll"])  # -> out, A; disabled
# ---------- c_script: C# usings ----------
using System.Net.Http;
using System.Text;
using System.Threading.Tasks;
using System.Drawing;
using System.IO;
using Newtonsoft.Json;
# ---------- c_script: C# ----------
  string jsonData = "{\"key\": \"value\"}";
  
  HttpPostScript httpPostScript = new HttpPostScript(); // Create an instance of the HttpPostScript class
  string result = httpPostScript.PostData(jsonData).Result; // Perform the POST request
  Print(result); // Output the result
# ---------- c_script: C# additional code ----------
  
  
  public class HttpPostScript
  {
    // Define the base URL where you want to send the POST request
    private const string BaseUrl = "https://example.com/api/endpoint";
    
    // Define a method to perform the POST request
    public async Task<string> PostData(string jsonData)
    {
      // Create an HttpClient instance
      using (HttpClient client = new HttpClient())
      {
        try
        {
          // Set the content type to "application/json"
          client.DefaultRequestHeaders.Accept.Clear();
          client.DefaultRequestHeaders.Accept.Add(new System.Net.Http.Headers.MediaTypeWithQualityHeaderValue("application/json"));

          // Convert the JSON data to a StringContent object
          var content = new StringContent(jsonData, Encoding.UTF8, "application/json");

          // Send the POST request and wait for the response
          HttpResponseMessage response = client.PostAsync(BaseUrl, content);

          // Ensure the response was successful
          response.EnsureSuccessStatusCode();

          // Read the response content as a string and return it
          string responseContent = response.Content.ReadAsStringAsync();
          return responseContent;
        }
        catch (HttpRequestException ex)
        {
          // Handle any exception that may occur during the request
          return "Error: " + ex.Message;
        }
      }
    }
  }
# ---------- end c_script ----------
c_script_2 = CSharpScript(Reference=["C:\Windows\WinSxS\amd64_system.net.http_b03f5f7f11d50a3a_4.0.15805.0_none_49364fe7559e5a05\System.Net.Http.dll", "C:\Windows\WinSxS\msil_hyperv-ux-ui-newtonsoftjson_31bf3856ad364e35_10.0.19041.1_none_f501448ecc10dc94\Newtonsoft.Json.dll"])  # -> out, A; disabled
# ---------- c_script_2: C# usings ----------
using System.Net.Http;
  using System.Threading.Tasks;
  using System.Drawing;
  using System.IO;
  using Newtonsoft.Json;
  using System.Text;
# ---------- c_script_2: C# ----------
    string path = Environment.GetFolderPath(Environment.SpecialFolder.Desktop);
    string timestamp = DateTime.Now.ToString("yyMMdd_HHmmss");

    Image img = new Bitmap(256, 256);

    if (TextToImage("a city street, post apocalyptic", ref img))
    {
      Print("yay!");
      img.Save(path + "\\" + timestamp + ".png", System.Drawing.Imaging.ImageFormat.Png);
    }
# ---------- c_script_2: C# additional code ----------
  static string GRADIO_ID = "35a3009982df853c8e";
  static string BASEURL = "https://" + GRADIO_ID + ".gradio.live:443/sdapi";


  bool TextToImage(string prompt, ref Image img)
  {

    Dictionary<string, object> pdata = new Dictionary<string, object>(BASEDATA_TXT_2_IMG); // Deep copy
    pdata["prompt"] = prompt;

    if (DoPostData(pdata, "/v1/txt2img", ref img)){
      Print("very good!");
      return true;
    } else {
      return false;
    }
  }

  bool DepthToImage(string prompt, string pth_dimg, ref Image img)
  {
    Dictionary<string, object> pdata = new Dictionary<string, object>(); // replace with your BASEDATA_TXT_2_IMG dictionary
    pdata["prompt"] = prompt;

    Image dimg = Image.FromFile(pth_dimg);
    pdata = AppendDepthImg(pdata, dimg);

    if (DoPostData(pdata, "/v1/txt2img", ref img)){
      Print("very good!");
      return true;
    } else {
      return false;
    }
  }



  bool DoPostData(Dictionary<string, object> pdata, string url, ref Image img)
  {
    url = BASEURL + url;
    HttpClient client = new HttpClient
      {
        Timeout = TimeSpan.FromSeconds(10)
        };
    StringContent content = new StringContent(JsonConvert.SerializeObject(pdata), Encoding.UTF8, "application/json");
    try
    {

      HttpResponseMessage response = client.PostAsync(url, content).Result;
      Print("URL: " + url);
      Print("Status Code: " + response.StatusCode);
      Print("Headers: " + response.Headers);

      if (response.IsSuccessStatusCode) {
        string responseData = response.Content.ReadAsStringAsync().Result;
        var json = JsonConvert.DeserializeObject<Dictionary<string, object>>(responseData);
         
        if (json.ContainsKey("images")) {
          var imagesBase64 = json["images"] as List<string>;
          var imgBase64 = imagesBase64[0];
          Print(imgBase64.ToString());
          Print(json["images"].ToString().Substring(0,100));
          byte[] imageBytes = Convert.FromBase64String(imagesBase64[0]); // Decode the first base64 image
          img = Image.FromStream(new MemoryStream(imageBytes)); // Create a System.Drawing.Image from the bytes
          return true;
          
        }
        return false;

      } else {
        Print("Bad response code: " + response.StatusCode);
        return false;
      }
    }
    catch (Exception e)
    {
      Print("EXCEPTION!");
      Print(e.ToString());
      return false;
    }
  }





  Dictionary<string, object> AppendDepthImg(Dictionary<string, object> pdata, Image img)
  {
    MemoryStream ms = new MemoryStream();
    img.Save(ms, System.Drawing.Imaging.ImageFormat.Png);
    byte[] byteImage = ms.ToArray();
    string base64String = Convert.ToBase64String(byteImage);

    Dictionary<string, object> cnscript_depth = new Dictionary<string, object>(); // Replace with your cnscript_depth dictionary
    cnscript_depth["input_image"] = base64String;

    pdata["alwayson_scripts"] = cnscript_depth;
    return pdata;
  }


  Dictionary<string, object> BASEDATA_TXT_2_IMG = new Dictionary<string, object>()
    {
      { "enable_hr", false },
      { "hr_scale", 2 },
      { "hr_upscaler", "Latent" },
      { "hr_second_pass_steps", 0 },
      { "hr_resize_x", 0 },
      { "hr_resize_y", 0 },
      { "denoising_strength", 0.7 },
      { "firstphase_width", 0 },
      { "firstphase_height", 0 },
      { "prompt", "" },
      { "styles", new List<object>() },
      { "seed", -1 },
      { "subseed", -1 },
      { "subseed_strength", 0.0 },
      { "seed_resize_from_h", 0 },
      { "seed_resize_from_w", 0 },
      { "batch_size", 1 },
      { "n_iter", 1 },
      { "steps", 20 },
      { "cfg_scale", 7 },
      { "width", 512 },
      { "height", 512 },
      { "restore_faces", false },
      { "tiling", false },
      { "do_not_save_samples", false },
      { "do_not_save_grid", false },
      { "negative_prompt", "" },
      { "eta", 1.0 },
      { "s_churn", 0 },
      { "s_tmax", 0 },
      { "s_tmin", 0 },
      { "s_noise", 1 },
      { "override_settings", new Dictionary<string, object>() },
      { "override_settings_restore_afterwards", true },
      { "sampler_name", "Euler a" },
      { "sampler_index", "Euler a" },
      { "script_name", null },
      { "script_args", new List<object>() },
      { "send_images", true },
      { "save_images", false },
      { "alwayson_scripts", new Dictionary<string, object>() }
      };
# ---------- end c_script_2 ----------
c_script_3 = CSharpScript(Reference=["C:\Windows\WinSxS\amd64_system.net.http_b03f5f7f11d50a3a_4.0.15805.0_none_49364fe7559e5a05\System.Net.Http.dll", "C:\Windows\WinSxS\msil_hyperv-ux-ui-newtonsoftjson_31bf3856ad364e35_10.0.19041.1_none_f501448ecc10dc94\Newtonsoft.Json.dll"])  # -> out, A; disabled
# ---------- c_script_3: C# ----------
    string path = Environment.GetFolderPath(Environment.SpecialFolder.Desktop);
    string timestamp = DateTime.Now.ToString("yyMMdd_HHmmss");

    Image img = new Bitmap(256, 256);

    if (TextToImage("a city street, post apocalyptic", ref img))
    {
      Print("yay!");
      img.Save(path + "\\" + timestamp + ".png", System.Drawing.Imaging.ImageFormat.Png);
    }
# ---------- c_script_3: C# additional code ----------
  static string GRADIO_ID = "35a3009982df853c8e";
  static string BASEURL = "https://" + GRADIO_ID + ".gradio.live:443/sdapi";


  bool TextToImage(string prompt, ref Image img)
  {

    Dictionary<string, object> pdata = new Dictionary<string, object>(BASEDATA_TXT_2_IMG); // Deep copy
    pdata["prompt"] = prompt;

    if (DoPostData(pdata, "/v1/txt2img", ref img)){
      Print("very good!");
      return true;
    } else {
      return false;
    }
  }

  bool DepthToImage(string prompt, string pth_dimg, ref Image img)
  {
    Dictionary<string, object> pdata = new Dictionary<string, object>(); // replace with your BASEDATA_TXT_2_IMG dictionary
    pdata["prompt"] = prompt;

    Image dimg = Image.FromFile(pth_dimg);
    pdata = AppendDepthImg(pdata, dimg);

    if (DoPostData(pdata, "/v1/txt2img", ref img)){
      Print("very good!");
      return true;
    } else {
      return false;
    }
  }



  bool DoPostData(Dictionary<string, object> pdata, string url, ref Image img)
  {
    url = BASEURL + url;
    HttpClient client = new HttpClient
      {
        Timeout = TimeSpan.FromSeconds(10)
        };
    StringContent content = new StringContent(JsonConvert.SerializeObject(pdata), Encoding.UTF8, "application/json");
    try
    {

      HttpResponseMessage response = client.PostAsync(url, content).Result;
      Print("URL: " + url);
      Print("Status Code: " + response.StatusCode);
      Print("Headers: " + response.Headers);

      if (response.IsSuccessStatusCode) {
        string responseData = response.Content.ReadAsStringAsync().Result;
        var json = JsonConvert.DeserializeObject<Dictionary<string, object>>(responseData);

        if (json.ContainsKey("images")) {
          var imagesBase64 = json["images"] as List<string>;
          if (imagesBase64 != null && imagesBase64.Count > 0)
          {
            byte[] imageBytes = Convert.FromBase64String(imagesBase64[0]); // Decode the first base64 image
            img = Image.FromStream(new MemoryStream(imageBytes)); // Create a System.Drawing.Image from the bytes
            return true;
          } else {
            Print("Key 'images' contained no data");
            return false;
          }
        } else {
          Print("Key 'images' not found in the response");
        }

      } else {
        Print("Bad response code: " + response.StatusCode);
        return false;
      }
    }
    catch (Exception e)
    {
      Print("The request timed out");
      Print(e.ToString());
      return false;
    }
  }





  Dictionary<string, object> AppendDepthImg(Dictionary<string, object> pdata, Image img)
  {
    MemoryStream ms = new MemoryStream();
    img.Save(ms, System.Drawing.Imaging.ImageFormat.Png);
    byte[] byteImage = ms.ToArray();
    string base64String = Convert.ToBase64String(byteImage);

    Dictionary<string, object> cnscript_depth = new Dictionary<string, object>(); // Replace with your cnscript_depth dictionary
    cnscript_depth["input_image"] = base64String;

    pdata["alwayson_scripts"] = cnscript_depth;
    return pdata;
  }


  Dictionary<string, object> BASEDATA_TXT_2_IMG = new Dictionary<string, object>()
    {
      { "enable_hr", false },
      { "hr_scale", 2 },
      { "hr_upscaler", "Latent" },
      { "hr_second_pass_steps", 0 },
      { "hr_resize_x", 0 },
      { "hr_resize_y", 0 },
      { "denoising_strength", 0.7 },
      { "firstphase_width", 0 },
      { "firstphase_height", 0 },
      { "prompt", "" },
      { "styles", new List<object>() },
      { "seed", -1 },
      { "subseed", -1 },
      { "subseed_strength", 0.0 },
      { "seed_resize_from_h", 0 },
      { "seed_resize_from_w", 0 },
      { "batch_size", 1 },
      { "n_iter", 1 },
      { "steps", 20 },
      { "cfg_scale", 7 },
      { "width", 512 },
      { "height", 512 },
      { "restore_faces", false },
      { "tiling", false },
      { "do_not_save_samples", false },
      { "do_not_save_grid", false },
      { "negative_prompt", "" },
      { "eta", 1.0 },
      { "s_churn", 0 },
      { "s_tmax", 0 },
      { "s_tmin", 0 },
      { "s_noise", 1 },
      { "override_settings", new Dictionary<string, object>() },
      { "override_settings_restore_afterwards", true },
      { "sampler_name", "Euler a" },
      { "sampler_index", "Euler a" },
      { "script_name", null },
      { "script_args", new List<object>() },
      { "send_images", true },
      { "save_images", false },
      { "alwayson_scripts", new Dictionary<string, object>() }
      };
# ---------- end c_script_3 ----------
c_script_4 = CSharpScript(Reference=["C:\Windows\WinSxS\amd64_system.net.http_b03f5f7f11d50a3a_4.0.15805.0_none_49364fe7559e5a05\System.Net.Http.dll", "C:\Windows\WinSxS\msil_hyperv-ux-ui-newtonsoftjson_31bf3856ad364e35_10.0.19041.1_none_f501448ecc10dc94\Newtonsoft.Json.dll"])  # -> out, A
# ---------- c_script_4: C# usings ----------
using System.Net.Http;
  using System.Threading.Tasks;
  using System.Drawing;
  using System.IO;
  using Newtonsoft.Json;
  using System.Text;
using Newtonsoft.Json.Linq;
# ---------- c_script_4: C# ----------
    string savepath = Environment.GetFolderPath(Environment.SpecialFolder.Desktop);
    string timestamp = DateTime.Now.ToString("yyMMdd_HHmmss");

    string depthpath = "D:\\GitHub\\stochastic_2023\\img_dpth\\01.jpg";
    
    Image img = new Bitmap(256, 256);
    if (DepthToImage("a city street, post apocalyptic", depthpath, ref img))
    {
      Print("main function success!");
      img.Save(savepath + "\\" + timestamp + ".png", System.Drawing.Imaging.ImageFormat.Png);
    }
# ---------- c_script_4: C# additional code ----------
  static string GRADIO_ID = "35a3009982df853c8e";
  static string BASEURL = "https://" + GRADIO_ID + ".gradio.live:443/sdapi";


  bool TextToImage(string prompt, ref Image img)
  {

    Dictionary<string, object> pdata = new Dictionary<string, object>(BASEDATA_TXT_2_IMG); // Deep copy
    pdata["prompt"] = prompt;

    if (DoPostData(pdata, "/v1/txt2img", ref img)){
      Print("TextToImage success!");
      return true;
    } else {
      return false;
    }
  }

  bool DepthToImage(string prompt, string pth_dimg, ref Image img)
  {
    Dictionary<string, object> pdata = new Dictionary<string, object>(); // replace with your BASEDATA_TXT_2_IMG dictionary
    pdata["prompt"] = prompt;

    Image dimg = Image.FromFile(pth_dimg);
    pdata = AppendDepthImg(pdata, dimg);

    if (DoPostData(pdata, "/v1/txt2img", ref img)){
      Print("DepthToImage success!");
      return true;
    } else {
      return false;
    }
  }



  bool DoPostData(Dictionary<string, object> pdata, string url, ref Image img)
  {
    url = BASEURL + url;
    HttpClient client = new HttpClient
      {
        Timeout = TimeSpan.FromSeconds(10)
        };
    StringContent content = new StringContent(JsonConvert.SerializeObject(pdata), Encoding.UTF8, "application/json");
    try
    {

      // Make the HTTP request and get the JSON response as a string
      HttpResponseMessage response = client.PostAsync(url, content).Result;
      response.EnsureSuccessStatusCode(); // Ensure the response was successful
      string jsonResponse = response.Content.ReadAsStringAsync().Result;
      JObject json = JObject.Parse(jsonResponse); // Parse the JSON response into a JObject
      JArray imagesArray = (JArray) json["images"]; // Extract the "images" array from the JSON

      // Check if the "images" array is not empty
      if (imagesArray != null && imagesArray.Count > 0)
      {

        string encodedImageData = imagesArray[0].ToString(); // Get the first image data from the "images" array
        byte[] imageDataBytes = Convert.FromBase64String(encodedImageData); // Convert the base64 encoded image data to a byte array

        // Create a MemoryStream to hold the image data
        using (MemoryStream ms = new MemoryStream(imageDataBytes))
        {

          img = Image.FromStream(ms); // Create a System.Drawing.Image object from the MemoryStream
          return true;
        }
      }
      Print("something went bad");
      return false;
    }
    catch (Exception e)
    {
      Print("EXCEPTION!");
      Print(e.ToString());
      return false;
    }
  }





  Dictionary<string, object> AppendDepthImg(Dictionary<string, object> pdata, Image img)
  {
    MemoryStream ms = new MemoryStream();
    img.Save(ms, System.Drawing.Imaging.ImageFormat.Png);
    byte[] byteImage = ms.ToArray();
    string base64String = Convert.ToBase64String(byteImage);

    Dictionary<string, object> cnscript_depth = new Dictionary<string, object>(); // Replace with your cnscript_depth dictionary
    cnscript_depth["input_image"] = base64String;
    
    /*
    Dictionary<string, Dictionary<string, List<Dictionary<string, object>>>> cnscript_depth = new Dictionary<string, Dictionary<string, List<Dictionary<string, object>>>>
      {
        {
          "ControlNet", new Dictionary<string, List<Dictionary<string, object>>>
          {
            {
              "args", new List<Dictionary<string, object>>
              {
                new Dictionary<string, object>
                {
                  { "input_image", base64String },
                  { "mask", null },
                  { "module", "depth" },
                  { "model", "control_v11f1p_sd15_depth [cfd03158]" },
                  { "weight", 1.0 },
                  { "resize_mode", "Resize and Fill" },
                  { "lowvram", false },
                  { "processor_res", 512 },
                  { "threshold_a", 64 },
                  { "threshold_b", 64 },
                  { "guidance", 1.0 },
                  { "guidance_start", 0.0 },
                  { "guidance_end", 1.0 },
                  { "control_mode", 0 },
                  { "pixel_perfect", false }
                  }
                }
              }
            }
          } 
        };  
    */
    

    pdata["alwayson_scripts"] = cnscript_depth;
    return pdata;
  }

  
  
  
  

  Dictionary<string, object> BASEDATA_TXT_2_IMG = new Dictionary<string, object>()
    {
      { "enable_hr", false },
      { "hr_scale", 2 },
      { "hr_upscaler", "Latent" },
      { "hr_second_pass_steps", 0 },
      { "hr_resize_x", 0 },
      { "hr_resize_y", 0 },
      { "denoising_strength", 0.7 },
      { "firstphase_width", 0 },
      { "firstphase_height", 0 },
      { "prompt", "" },
      { "styles", new List<object>() },
      { "seed", -1 },
      { "subseed", -1 },
      { "subseed_strength", 0.0 },
      { "seed_resize_from_h", 0 },
      { "seed_resize_from_w", 0 },
      { "batch_size", 1 },
      { "n_iter", 1 },
      { "steps", 20 },
      { "cfg_scale", 7 },
      { "width", 512 },
      { "height", 512 },
      { "restore_faces", false },
      { "tiling", false },
      { "do_not_save_samples", false },
      { "do_not_save_grid", false },
      { "negative_prompt", "" },
      { "eta", 1.0 },
      { "s_churn", 0 },
      { "s_tmax", 0 },
      { "s_tmin", 0 },
      { "s_noise", 1 },
      { "override_settings", new Dictionary<string, object>() },
      { "override_settings_restore_afterwards", true },
      { "sampler_name", "Euler a" },
      { "sampler_index", "Euler a" },
      { "script_name", null },
      { "script_args", new List<object>() },
      { "send_images", true },
      { "save_images", false },
      { "alwayson_scripts", new Dictionary<string, object>() }
      };
# ---------- end c_script_4 ----------
panel = Panel(c_script_4.out)
panel_2 = Panel(c_script_4.A)
