# Grasshopper definition capture_depth.gh (Grasshopper 1.0.7)

python = GhPythonScript(view_name="perspective")  # -> out, a
# ---------- python: Python ----------
import System
import Rhino
import scriptcontext as sc


def get_view(name):
    view = filter(lambda v: (v.ActiveViewport.Name.lower() == name), sc.doc.Views)
    if len(view)==1: return view[0]
    print("a view named '{}' not found, using active view".format(name))
    return sc.doc.Views.ActiveView
    
def view_depthmap(view):
    dmode_rdr = Rhino.Display.DisplayModeDescription.FindByName('Shaded')
    zcap = Rhino.Display.ZBufferCapture(view.MainViewport)
    zcap.SetDisplayMode(dmode_rdr.Id)
    bmp = zcap.GrayscaleDib()
    return bmp

def save_bmp_to_file(bmp):
    folder = System.Environment.SpecialFolder.Desktop
    path = System.Environment.GetFolderPath(folder)
    filename = System.IO.Path.Combine(path, "SampleViewCaptureToFile.png");
    bmp.Save(filename, System.Drawing.Imaging.ImageFormat.Png);
            
            
            
view = get_view(view_name)
dmap = view_depthmap(view)
save_bmp_to_file(dmap)

from urllib import urlencode
from urllib2 import Request, urlopen, URLError
url = "https://httpbin.org/post"

values = {
    'name' : 'your name',
    'location' : 'test location',
    'language' : 'Python'
}

data = urlencode(values)
req = Request(url, data)

try:
    response = urlopen(req)
except URLError, e:
    if hasattr(e, 'reason'):
        print 'We failed to reach a server.'
        print 'Reason: ', e.reason
    elif hasattr(e, 'code'):
        print 'The server couldn\'t fulfill the request.'
        print 'Error code: ', e.code
else:
    print("response ok")
    the_page = response.read()
    print(the_page)
# ---------- end python ----------
panel = Panel(python.out)
panel_2 = Panel(python.a)
