# Grasshopper definition 230730b.gh (Grasshopper 1.0.7)

panel = Panel("D:\GitHub\stochastic_2023\_out")
panel_2 = Panel("a beautiful beautiful golden glowing box next to some tiny soccer balls+ with chromatic reflections under studio lighting")
c_script = CSharpScript(refreshView=Button(), savepath=panel, viewName="perspective")  # -> out, A; inputs refreshView: Boolean, savepath: String, viewName: String
# ---------- c_script: C# usings ----------
using System.Drawing;
using System.IO;
# ---------- c_script: C# ----------
    string timestamp = DateTime.Now.ToString("yyMMdd_HHmmss");
    
    
    Rhino.Display.RhinoView view = getView(viewName);
    Bitmap b = getDepthBitmap(view, 512);
    A = b;

    b.Save(savepath + "\\" + timestamp + "_depth.png", System.Drawing.Imaging.ImageFormat.Png);

    // string desktopPath = Environment.GetFolderPath(Environment.SpecialFolder.Desktop);
    // string filePath = Path.Combine(desktopPath, "depth.png");
    // if (b != null) b.Save(filePath);
# ---------- c_script: C# additional code ----------
  Rhino.Display.RhinoView getView(string viewName){
    Rhino.RhinoDoc rhinoDoc = Rhino.RhinoDoc.ActiveDoc;
    Rhino.Display.RhinoView namedView = null;

    // Attempt to find a view with the specified name.
    foreach (Rhino.Display.RhinoView view in rhinoDoc.Views)
    {

      if (view.MainViewport.Name.Equals(viewName, StringComparison.CurrentCultureIgnoreCase))
      {
        namedView = view;
        break;
      }
    }

    // If a view with the specified name was found, return it.
    if (namedView != null)
    {

      Print(String.Format("Found a view named {0}", viewName));
      return namedView;
    }
    else
    {
      // If no view with the specified name was found, return the active view.
      Rhino.Display.RhinoView activeView = rhinoDoc.Views.ActiveView;
      if (activeView == null){
        Print(String.Format("Could not find a view named {0}, and could not find ActiveView. No bueno.", viewName));
        return null;
      } else {
        Print(String.Format("Could not find a view named {0}. Falling back to ActiveView.", viewName));
        return activeView;
      }
    }

  }


  Bitmap getDepthBitmap(Rhino.Display.RhinoView view, int minDim)
  {
    if(view != null)
    {
      bool viewMaximizationState = view.Maximized;
      view.Maximized = true;
      if (Math.Min(view.Size.Width, view.Size.Height) < minDim){
        Print(String.Format("Viewport too small to meet minDim requirement of {0}. No bueno.", minDim));
        return null;
      }

      var dmode_rdr = Rhino.Display.DisplayModeDescription.FindByName("Shaded");
      var zcap = new Rhino.Display.ZBufferCapture(view.ActiveViewport);
      zcap.SetDisplayMode(dmode_rdr.Id);
      var bmp = zcap.GrayscaleDib();

      view.Maximized = viewMaximizationState;


      int smallerDimension = Math.Min(bmp.Width, bmp.Height); // Determine the smaller dimension.
      float scale = (float) minDim / smallerDimension; // Calculate the scale factor.
      int newWidth = (int) (bmp.Width * scale); // Calculate the new dimensions while maintaining the aspect ratio.
      int newHeight = (int) (bmp.Height * scale);
      Bitmap resizedBitmap = new Bitmap(bmp, new Size(newWidth, newHeight)); // Create a new bitmap with the new dimensions.

      Print(String.Format("Created a zBufferCapture of size {0}x{1} resized to {2}x{3}", bmp.Width, bmp.Height, resizedBitmap.Width, resizedBitmap.Height));
      return resizedBitmap;
    }
    else
    {
      Print("Invalid view.");
      return null;
    }
  }
# ---------- end c_script ----------
panel_3 = Panel(c_script.out)
c_script_2 = CSharpScript(
    doIt=Button(),
    savepath=panel,
    gradioID="6f13a8bef1d231d6b9",
    prompt=panel_2,
    depthBitmap=c_script.A,
    Reference=["C:\Windows\WinSxS\amd64_system.net.http_b03f5f7f11d50a3a_4.0.15805.0_none_49364fe7559e5a05\System.Net.Http.dll", "C:\Windows\WinSxS\msil_hyperv-ux-ui-newtonsoftjson_31bf3856ad364e35_10.0.19041.1_none_f501448ecc10dc94\Newtonsoft.Json.dll"])  # -> out, A; inputs doIt: Boolean, savepath: String, gradioID: String, prompt: String
# ---------- c_script_2: C# usings ----------
using Newtonsoft.Json;
using Newtonsoft.Json.Linq;
using System.Drawing;
using System.IO;
using System.Net.Http;
using System.Text;
# ---------- c_script_2: C# ----------
    if (doIt){

      string timestamp = DateTime.Now.ToString("yyMMdd_HHmmss");
      string baseURL = "https://" + gradioID + ".gradio.live:443/sdapi";
      string url = baseURL + "/v1/txt2img";

      StringBuilder log = new StringBuilder();
      log.AppendLine(String.Format("baseURL: {0}", baseURL));

      try{

        //Image depthImage = LoadImage("D:\\GitHub\\stochastic_2023\\img_dpth\\01.jpg");
        Image depthImage = depthBitmap as Image; // Cast Bitmap to Image.
        Automatic1111Script controlNet = BaseControlNetImg2ImgScript(depthImage, "depth", "control_v11f1p_sd15_depth [cfd03158]");

        Automatic1111Payload payload = BasePayload(depthImage.Width, depthImage.Height);
        payload.Prompt = prompt;
        payload.AlwaysonScripts.Add("ControlNet", controlNet);

        string jsonString = JsonConvert.SerializeObject(payload, Formatting.Indented);
        log.AppendLine(String.Format("payload: {0}", jsonString));


        Image img = new Bitmap(256, 256);
        string response = "";
        if (DoPostData(payload, url, ref img, ref response)){
          Print("DoPostData success!");
          img.Save(savepath + "\\" + timestamp + ".png", System.Drawing.Imaging.ImageFormat.Png);
          log.AppendLine(String.Format("response: {0}", response));
        } else {
          Print("DoPostData fail!");
          log.AppendLine(String.Format("response: {0}", response));
        }

      } catch (Exception e) {
        log.AppendLine(String.Format("response: {0}", e.ToString()));

      } finally {

        File.AppendAllText(savepath + "\\" + timestamp + "_log.txt", log.ToString());
      }

    }
# ---------- c_script_2: C# additional code ----------
  static int TIMEOUT = 20;

  bool DoPostData(Automatic1111Payload payload, string url, ref Image img, ref string responseReturn)
  {

    HttpClient client = new HttpClient
      {
        Timeout = TimeSpan.FromSeconds(TIMEOUT)
        };


    var content = new StringContent(JsonConvert.SerializeObject(payload), Encoding.UTF8, "application/json");

    try
    {

      // Make the HTTP request and get the JSON response as a string
      HttpResponseMessage response = client.PostAsync(url, content).Result;
      response.EnsureSuccessStatusCode(); // Ensure the response was successful
      string jsonResponse = response.Content.ReadAsStringAsync().Result;
      responseReturn = jsonResponse;
      JObject json = JObject.Parse(jsonResponse); // Parse the JSON response into a JObject
      JArray imagesArray = (JArray) json["images"]; // Extract the "images" array from the JSON

      // Check if the "images" array is not empty
      if (imagesArray != null && imagesArray.Count > 0)
      {

        string encodedImageData = imagesArray[0].ToString(); // Get the first image data from the "images" array
        byte[] imageDataBytes = Convert.FromBase64String(encodedImageData); // Convert the base64 encoded image data to a byte array

        // Create a MemoryStream to hold the image data
        using (MemoryStream ms = new MemoryStream(imageDataBytes))
        {

          img = Image.FromStream(ms); // Create a System.Drawing.Image object from the MemoryStream
          return true;
        }
      }
      Print("something went bad");
      return false;
    }
    catch (Exception e)
    {
      Print("EXCEPTION!");
      Print(e.ToString());
      responseReturn = e.ToString();
      return false;
    }
  }


  public Automatic1111Script BaseControlNetImg2ImgScript(Image img, string module, string model)
  {
    var controlNet = new Automatic1111Script
      {
        Args = new List<ScriptArgs>
        {
          new ScriptArgs
          {
            InputImage = null,
            Mask = null,
            Module = "", //"depth",
            Model = "", //"control_v11f1p_sd15_depth [cfd03158]",
            Weight = 1.0,
            ResizeMode = "Resize and Fill",
            Lowvram = false,
            ProcessorRes = 512,
            ThresholdA = 64,
            ThresholdB = 64,
            Guidance = 1.0,
            GuidanceStart = 0.0,
            GuidanceEnd = 1.0,
            ControlMode = 0,
            PixelPerfect = false
            }
          }
        };
    controlNet.Args[0].InputImage = img;
    controlNet.Args[0].Module = module;
    controlNet.Args[0].Model = model;


    return controlNet;
  }


  public Automatic1111Payload BasePayload(int width, int height)
  {
    Automatic1111Payload payload = new Automatic1111Payload
      {
        EnableHr = false,
        HrScale = 2,
        HrUpscaler = "Latent",
        HrSecondPassSteps = 0,
        HrResizeX = 0,
        HrResizeY = 0,
        DenoisingStrength = 0.7,
        FirstphaseWidth = 0,
        FirstphaseHeight = 0,
        Prompt = "",
        Styles = new List<object>(),  // or initialize with actual styles if available
        Seed = -1,
        Subseed = -1,
        SubseedStrength = 0.0,
        SeedResizeFromH = 0,
        SeedResizeFromW = 0,
        BatchSize = 1,
        NIter = 1,
        Steps = 20,
        CfgScale = 7,
        Width = -1,
        Height = -1,
        RestoreFaces = false,
        Tiling = false,
        DoNotSaveSamples = false,
        DoNotSaveGrid = false,
        NegativePrompt = "",
        Eta = 1.0,
        SChurn = 0,
        STMax = 0,
        STMin = 0,
        SNoise = 1,
        OverrideSettings = new Dictionary<string, object>(),  // or initialize with actual settings if available
        OverrideSettingsRestoreAfterwards = true,
        SamplerName = "Euler a",
        SamplerIndex = "Euler a",
        ScriptName = null,
        ScriptArgs = new List<object>(),  // or initialize with actual args if available
        SendImages = true,
        SaveImages = false,
        AlwaysonScripts = new Dictionary<string, Automatic1111Script>()
        };

    payload.Width = width;
    payload.Height = height;

    return payload;
  }


  public class Automatic1111Payload
  {
    [JsonProperty("enable_hr")]
    public bool EnableHr { get; set; }

    [JsonProperty("hr_scale")]
    public int HrScale { get; set; }

    [JsonProperty("hr_upscaler")]
    public string HrUpscaler { get; set; }

    [JsonProperty("hr_second_pass_steps")]
    public int HrSecondPassSteps { get; set; }

    [JsonProperty("hr_resize_x")]
    public int HrResizeX { get; set; }

    [JsonProperty("hr_resize_y")]
    public int HrResizeY { get; set; }

    [JsonProperty("denoising_strength")]
    public double DenoisingStrength { get; set; }

    [JsonProperty("firstphase_width")]
    public int FirstphaseWidth { get; set; }

    [JsonProperty("firstphase_height")]
    public int FirstphaseHeight { get; set; }

    [JsonProperty("prompt")]
    public string Prompt { get; set; }

    [JsonProperty("styles")]
    public List<object> Styles { get; set; }

    [JsonProperty("seed")]
    public int Seed { get; set; }

    [JsonProperty("subseed")]
    public int Subseed { get; set; }

    [JsonProperty("subseed_strength")]
    public double SubseedStrength { get; set; }

    [JsonProperty("seed_resize_from_h")]
    public int SeedResizeFromH { get; set; }

    [JsonProperty("seed_resize_from_w")]
    public int SeedResizeFromW { get; set; }

    [JsonProperty("batch_size")]
    public int BatchSize { get; set; }

    [JsonProperty("n_iter")]
    public int NIter { get; set; }

    [JsonProperty("steps")]
    public int Steps { get; set; }

    [JsonProperty("cfg_scale")]
    public int CfgScale { get; set; }

    [JsonProperty("width")]
    public int Width { get; set; }

    [JsonProperty("height")]
    public int Height { get; set; }

    [JsonProperty("restore_faces")]
    public bool RestoreFaces { get; set; }

    [JsonProperty("tiling")]
    public bool Tiling { get; set; }

    [JsonProperty("do_not_save_samples")]
    public bool DoNotSaveSamples { get; set; }

    [JsonProperty("do_not_save_grid")]
    public bool DoNotSaveGrid { get; set; }

    [JsonProperty("negative_prompt")]
    public string NegativePrompt { get; set; }

    [JsonProperty("eta")]
    public double Eta { get; set; }

    [JsonProperty("s_churn")]
    public int SChurn { get; set; }

    [JsonProperty("s_tmax")]
    public int STMax { get; set; }

    [JsonProperty("s_tmin")]
    public int STMin { get; set; }

    [JsonProperty("s_noise")]
    public int SNoise { get; set; }

    [JsonProperty("override_settings")]
    public Dictionary<string, object> OverrideSettings { get; set; }

    [JsonProperty("override_settings_restore_afterwards")]
    public bool OverrideSettingsRestoreAfterwards { get; set; }

    [JsonProperty("sampler_name")]
    public string SamplerName { get; set; }

    [JsonProperty("sampler_index")]
    public string SamplerIndex { get; set; }

    [JsonProperty("script_name")]
    public object ScriptName { get; set; }

    [JsonProperty("script_args")]
    public List<object> ScriptArgs { get; set; }

    [JsonProperty("send_images")]
    public bool SendImages { get; set; }

    [JsonProperty("save_images")]
    public bool SaveImages { get; set; }

    [JsonProperty("alwayson_scripts")]
    public Dictionary<string, Automatic1111Script> AlwaysonScripts { get; set; }
  }

  public class Automatic1111Script
  {
    [JsonProperty("args")]
    public List<ScriptArgs> Args { get; set; }
  }

  public class ScriptArgs
  {

    [JsonProperty("input_image")]
    [JsonConverter(typeof(ImageConverter))]
    public Image InputImage { get; set; }

    [JsonProperty("mask")]
    public object Mask { get; set; }

    [JsonProperty("module")]
    public string Module { get; set; }

    [JsonProperty("model")]
    public string Model { get; set; }

    [JsonProperty("weight")]
    public double Weight { get; set; }

    [JsonProperty("resize_mode")]
    public string ResizeMode { get; set; }

    [JsonProperty("lowvram")]
    public bool Lowvram { get; set; }

    [JsonProperty("processor_res")]
    public int ProcessorRes { get; set; }

    [JsonProperty("threshold_a")]
    public int ThresholdA { get; set; }

    [JsonProperty("threshold_b")]
    public int ThresholdB { get; set; }

    [JsonProperty("guidance")]
    public double Guidance { get; set; }

    [JsonProperty("guidance_start")]
    public double GuidanceStart { get; set; }

    [JsonProperty("guidance_end")]
    public double GuidanceEnd { get; set; }

    [JsonProperty("control_mode")]
    public int ControlMode { get; set; }

    [JsonProperty("pixel_perfect")]
    public bool PixelPerfect { get; set; }
  }


  public class ImageConverter : JsonConverter
  {
    public override bool CanConvert(Type objectType)
    {
      return objectType == typeof(Image);
    }

    public override void WriteJson(JsonWriter writer, object value, JsonSerializer serializer)
    {
      Image image = (Image) value;
      MemoryStream ms = new MemoryStream();
      image.Save(ms, System.Drawing.Imaging.ImageFormat.Png);
      byte[] imageBytes = ms.ToArray();
      string base64String = Convert.ToBase64String(imageBytes);
      writer.WriteValue(base64String);
    }

    public override object ReadJson(JsonReader reader, Type objectType, object existingValue, JsonSerializer serializer)
    {
      string base64String = (string) reader.Value;
      byte[] imageBytes = Convert.FromBase64String(base64String);
      MemoryStream ms = new MemoryStream(imageBytes, 0, imageBytes.Length);
      {
        ms.Write(imageBytes, 0, imageBytes.Length);
        Image image = Image.FromStream(ms, true);
        return image;
      }
    }
  }


  public System.Drawing.Image LoadImage(string imagePath)
  {
    return System.Drawing.Image.FromFile(imagePath);
    /*
    using (FileStream fs = new FileStream(imagePath, FileMode.Open, FileAccess.Read))
    {
      return System.Drawing.Image.FromStream(fs);
    }
    */
  }
# ---------- end c_script_2 ----------
panel_4 = Panel(c_script_2.A)
panel_5 = Panel(c_script_2.out)
