# Grasshopper definition display_conduit.gh (Grasshopper 1.0.7)

# ---- group: turn off display conduit
c_script = CSharpScript(doIt=Button())  # -> out, A; inputs doIt: Boolean
# ---------- c_script: C# ----------
    if (doIt){
      string key = "ksteinfe";
      disableRuntimeConduit(key);
    }
# ---------- c_script: C# additional code ----------
  void disableRuntimeConduit(string key){
    Rhino.Display.DisplayConduit conduit = Rhino.RhinoDoc.ActiveDoc.RuntimeData.TryGetValue<Rhino.Display.DisplayConduit>(key);
    if (conduit != null){
      conduit.Enabled = false;
      Print(String.Format("conduit {0} disabled",conduit.ToString()));
    } else {
      Print(String.Format("key {0} not found in RuntimeData",key));
    }
  }
# ---------- end c_script ----------

# ----
c_script_2 = CSharpScript(doIt=Button())  # -> out, A; inputs doIt: Boolean
# ---------- c_script_2: C# usings ----------
using Rhino.Display;
# ---------- c_script_2: C# ----------
    if (doIt){

      string key = "ksteinfe";
      disableRuntimeConduit(key);
      Func<RhinoDoc, MyConduit> initFunc = (doc) => new MyConduit(); // Here's a function that creates a new value instance
      MyConduit conduit = Rhino.RhinoDoc.ActiveDoc.RuntimeData.GetValue(key, initFunc); // Call GetValue function with a key and function to create new value if key is not found or value is null

      conduit.Enabled = true;

      //Rhino.Display.DisplayModeDescription dmode = new Rhino.Display.DisplayModeDescription();

      Rhino.Display.RhinoView view = getView("perspective");
      view.MainViewport.ConstructionGridVisible = false;
      view.MainViewport.WorldAxesVisible = false;
      view.MainViewport.ConstructionAxesVisible = false;
      

      System.Drawing.Size size = new System.Drawing.Size(512, 512);



      //view.DisplayPipeline.EnableLighting(false);

      //Rhino.Display.DisplayPipelineAttributes attr = new Rhino.Display.DisplayPipelineAttributes();
      Rhino.Display.DisplayPipelineAttributes attr = view.DisplayPipeline.DisplayPipelineAttributes;
      attr.ShowIsoCurves = false;
      attr.ShowIsoCurves = false;
      attr.CastShadows = false;
      attr.ShowSurfaceEdges = false;
      attr.ShowTangentEdges = false;
      attr.ShowTangentSeams = false;
      attr.ShadingEnabled = false;
      attr.AmbientLightingColor = System.Drawing.Color.FromArgb(255, 0, 0, 0);
      attr.FillMode = DisplayPipelineAttributes.FrameBufferFillMode.SolidColor;
      attr.SetFill(System.Drawing.Color.FromArgb(255, 0, 0, 0));


      System.Drawing.Bitmap bmp = view.CaptureToBitmap(size, attr);


      string timestamp = DateTime.Now.ToString("yyMMdd_HHmmss");
      string savepath = "D:\\GitHub\\stochastic_2023\\230731";
      bmp.Save(savepath + "\\" + timestamp + ".png", System.Drawing.Imaging.ImageFormat.Png);

    }
# ---------- c_script_2: C# additional code ----------
  void disableRuntimeConduit(string key){
    Rhino.Display.DisplayConduit conduit = Rhino.RhinoDoc.ActiveDoc.RuntimeData.TryGetValue<Rhino.Display.DisplayConduit>(key);
    if (conduit != null){
      conduit.Enabled = false;
      Print(String.Format("conduit {0} disabled", conduit.ToString()));
    } else {
      Print(String.Format("key {0} not found in RuntimeData", key));
    }
  }

  Rhino.Display.RhinoView getView(string viewName){
    Rhino.RhinoDoc rhinoDoc = Rhino.RhinoDoc.ActiveDoc;
    Rhino.Display.RhinoView namedView = null;

    // Attempt to find a view with the specified name.
    foreach (Rhino.Display.RhinoView view in rhinoDoc.Views)
    {

      if (view.MainViewport.Name.Equals(viewName, StringComparison.CurrentCultureIgnoreCase))
      {
        namedView = view;
        break;
      }
    }

    // If a view with the specified name was found, return it.
    if (namedView != null)
    {

      Print(String.Format("Found a view named {0}", viewName));
      return namedView;
    }
    else
    {
      // If no view with the specified name was found, return the active view.
      Rhino.Display.RhinoView activeView = rhinoDoc.Views.ActiveView;
      if (activeView == null){
        Print(String.Format("Could not find a view named {0}, and could not find ActiveView. No bueno.", viewName));
        return null;
      } else {
        Print(String.Format("Could not find a view named {0}. Falling back to ActiveView.", viewName));
        return activeView;
      }
    }

  }


  class MyConduit : Rhino.Display.DisplayConduit
  {

    private List<Mesh> drawmeshes;
    /*
    public Script_Instance ghScript;
    public MyConduit(Script_Instance ghs) : base()
    {
      this.ghScript = ghs;
    }
    */

    protected override void CalculateBoundingBox(CalculateBoundingBoxEventArgs e)
    {
      base.CalculateBoundingBox(e);
      this.drawmeshes = new List<Mesh>();

      e.Display.EnableLighting(false);
    }

    protected override void PostDrawObjects(DrawEventArgs e)
    {
      base.PostDrawObjects(e);

      Rhino.RhinoApp.WriteLine(String.Format("drawing {0} meshes", this.drawmeshes.Count.ToString()));

      Random random = new Random(DateTime.Now.Millisecond);
      foreach (Mesh msh in this.drawmeshes)
      {
        int r = random.Next(128, 200);
        int g = random.Next(128, 200);
        int b = random.Next(128, 200);
        //Rhino.RhinoApp.WriteLine(String.Format("{0},{1},{2}", r, g, b));

        System.Drawing.Color clr = System.Drawing.Color.FromArgb(255, r, g, b);
        System.Drawing.Color ems = System.Drawing.Color.FromArgb(255, 0, 0, 0);
        DisplayMaterial mat = new DisplayMaterial(clr);
        mat.Emission = ems;
        e.Display.DrawMeshShaded(msh, mat);

      }

    }



    protected override void PreDrawObject(DrawObjectEventArgs e)
    {
      base.PreDrawObject(e);
      //Rhino.RhinoApp.WriteLine(e.RhinoObject.ToString());


      foreach (Mesh msh in e.RhinoObject.GetMeshes(Rhino.Geometry.MeshType.Render))
      {
        this.drawmeshes.Add(msh);
      }


    }


  }
# ---------- end c_script_2 ----------
panel = Panel(c_script_2.out)
panel_2 = Panel(c_script.out)
