# Grasshopper definition 230802b Combined.gh (Grasshopper 1.0.7)

panel = Panel("D:\GitHub\stochastic_2023\_out")
toggle = BooleanToggle(True)
button = Button()

# ---- group: semantic
c_script = CSharpScript(
    refresh=button,
    doSaveLocal=toggle,
    savePath=panel,
    viewName="perspective",
    Reference="C:\Windows\WinSxS\msil_hyperv-ux-ui-newtonsoftjson_31bf3856ad364e35_10.0.19041.1_none_f501448ecc10dc94\Newtonsoft.Json.dll")  # -> out, A, B; inputs refresh: Boolean, doSaveLocal: Boolean, savePath: String, viewName: String
# ---------- c_script: C# usings ----------
using System.IO;
using System.Drawing;
using Rhino.DocObjects;
using System.Collections.Specialized;
using Newtonsoft.Json;
# ---------- c_script: C# ----------
    string timestamp = DateTime.Now.ToString("yyMMdd_HHmmss");

    Color promptlessColor = System.Drawing.Color.FromArgb(255, 10, 10, 10);
    string promptKey = "prompt";



    var doc = RhinoDoc.ActiveDoc;

    // Iterate over every object in the Rhino model and store its ObjectColor and ColorSource
    // Set all displaycolors to the promptless color
    Dictionary<Guid, Tuple<Color, ObjectColorSource>> colorSettings = new Dictionary<Guid, Tuple<Color, ObjectColorSource>>();
    foreach (var rhinoObject in doc.Objects)
    {
      colorSettings[rhinoObject.Id] = Tuple.Create(rhinoObject.Attributes.ObjectColor, rhinoObject.Attributes.ColorSource);
      rhinoObject.Attributes.ColorSource = ObjectColorSource.ColorFromObject;
      rhinoObject.Attributes.ObjectColor = promptlessColor;
      rhinoObject.CommitChanges();
    }

    Dictionary<Color, Tuple<string, List<Guid>>> promptDict = generatePromptDict(promptKey);
    string jsonString = convertDictToJsonString(promptDict);
    if (doSaveLocal) File.WriteAllText(Path.Combine(savePath, timestamp + "_semanticmap.json"), jsonString); // Save the JSON string to the specified file
    B = jsonString;

    // Iterate over each prompt and change the ObjectColor of all related objects
    foreach (KeyValuePair<Color, Tuple<string, List<Guid>>> entry in promptDict)
    {
      Color color = entry.Key;
      string prompt = entry.Value.Item1;
      foreach (Guid guid in entry.Value.Item2)
      {
        RhinoObject rhinoObject = doc.Objects.Find(guid);
        if (rhinoObject != null){
          rhinoObject.Attributes.ObjectColor = color;
          rhinoObject.CommitChanges();
        }
      }
    }
    doc.Views.Redraw(); // Make sure changes are redrawn


    // Capture Bitmap
    Rhino.Display.RhinoView view = getView(viewName);
    if (view == null) return;

    Bitmap bmp = null;
    if (doCaptureFlatColorBitmap(view, ref bmp, 512)){
      if (doSaveLocal) bmp.Save(Path.Combine(savePath, timestamp + "_semantic.png"));
      A = bmp;
    }


    // Iterate over each object and restore the previous settings
    foreach (var rhinoObject in doc.Objects)
    {
      if (colorSettings.ContainsKey(rhinoObject.Id))
      {
        var colorSetting = colorSettings[rhinoObject.Id];
        rhinoObject.Attributes.ObjectColor = colorSetting.Item1;
        rhinoObject.Attributes.ColorSource = colorSetting.Item2;
        rhinoObject.CommitChanges();
      }
    }


    doc.Views.Redraw(); // Make sure changes are redrawn
# ---------- c_script: C# additional code ----------
  public Dictionary<Color, Tuple<string, List<Guid>>> generatePromptDict(string promptKey){

    // Collect all prompts and related objects
    Dictionary<string, List<Guid>> promptDict = new Dictionary<string, List<Guid>>();
    foreach (var rhinoObject in doc.Objects)
    {
      NameValueCollection userStrings = rhinoObject.Attributes.GetUserStrings(); // Get the user strings
      string promptStr = userStrings.Get(promptKey);
      if (promptStr != null){ // if this object has an associated prompt
        if (promptDict.ContainsKey(promptStr)) promptDict[promptStr].Add(rhinoObject.Id);
        else promptDict[promptStr] = new List<Guid>() { rhinoObject.Id };
      }
    }
    Print(String.Format("Found {0} unique prompts", promptDict.Count));
    List<Color> colors = GenerateDistinctColors(promptDict.Count);

    // construct result
    Dictionary<Color, Tuple<string, List<Guid>>> result = new Dictionary<Color, Tuple<string, List<Guid>>>();
    int colorIndex = 0;
    foreach (var entry in promptDict)
    {
      result[colors[colorIndex++]] = new Tuple<string, List<Guid>>(entry.Key, entry.Value);
    }

    return result;

  }

  public string convertDictToJsonString(Dictionary<Color, Tuple<string, List<Guid>>> promptDict)
  {
    // Construct a list of dictionaries
    List<Dictionary<string, object>> dictList = new List<Dictionary<string, object>>();
    foreach (var entry in promptDict)
    {
      Dictionary<string, object> dict = new Dictionary<string, object>();
      dict.Add("color", new List<int> { entry.Key.R, entry.Key.G, entry.Key.B });
      dict.Add("prompt", entry.Value.Item1);
      dictList.Add(dict);
    }


    string jsonString = JsonConvert.SerializeObject(dictList, Formatting.Indented); // Convert the dictionary to a JSON string
    return jsonString;

  }


  public void restoreSelection(List<Guid> selectedObjectIds){
    // Restore the previous selection
    foreach (var id in selectedObjectIds)
    {
      var obj = RhinoDoc.ActiveDoc.Objects.Find(id);
      if (obj != null)obj.Select(true);
    }
    RhinoDoc.ActiveDoc.Views.Redraw();
  }

  public bool doCaptureFlatColorBitmap(Rhino.Display.RhinoView view, ref Bitmap bitmap, int minDim){

    // maximize view and test size
    bool viewMaximizationState = view.Maximized;
    view.Maximized = true;
    if (Math.Min(view.Size.Width, view.Size.Height) < minDim){
      Print(String.Format("Viewport too small to meet minDim requirement of {0}. No bueno.", minDim));
      view.Maximized = viewMaximizationState; // unmaximize view
      return false;
    }

    // Save all selected objects and deselect
    List<Guid> selectedObjectIds = new List<Guid>();
    foreach (var obj in RhinoDoc.ActiveDoc.Objects.GetSelectedObjects(false, false)) selectedObjectIds.Add(obj.Id);
    RhinoDoc.ActiveDoc.Objects.UnselectAll(); // Deselect all objects

    Guid userDisplayModeId = view.ActiveViewport.DisplayMode.Id;

    Guid displayModeId = new Guid();
    if (createTempFlatColorDisplayMode(ref displayModeId)){
      try {
        //Print(String.Format("Capturing view with temporary displaymode {0}", displayModeId.ToString()));
        view.ActiveViewport.DisplayMode = Rhino.Display.DisplayModeDescription.GetDisplayMode(displayModeId);
        Rhino.Display.DisplayModeDescription dispModeDescription = Rhino.Display.DisplayModeDescription.GetDisplayMode(displayModeId);
        Bitmap bmp = view.CaptureToBitmap(view.Size, dispModeDescription);
        if (bmp != null){
          restoreSelection(selectedObjectIds);
          view.Maximized = viewMaximizationState; // unmaximize view

          int smallerDimension = Math.Min(bmp.Width, bmp.Height); // Determine the smaller dimension.
          float scale = (float) minDim / smallerDimension; // Calculate the scale factor.
          int newWidth = (int) (bmp.Width * scale); // Calculate the new dimensions while maintaining the aspect ratio.
          int newHeight = (int) (bmp.Height * scale);
          Bitmap resizedBitmap = new Bitmap(bmp, new Size(newWidth, newHeight)); // Create a new bitmap with the new dimensions.

          Print(String.Format("Created a semanticMap of size {0}x{1} resized to {2}x{3}", bmp.Width, bmp.Height, resizedBitmap.Width, resizedBitmap.Height));
          bitmap = resizedBitmap;

          return true;
        }
        Print("doCaptureFlatColorBitmap: Bitmap was null");
      } catch (Exception ex) {
        Print("A main function exception occurred: " + ex.Message);
      } finally {
        view.ActiveViewport.DisplayMode = Rhino.Display.DisplayModeDescription.GetDisplayMode(userDisplayModeId);
        Rhino.Display.DisplayModeDescription.DeleteDisplayMode(displayModeId);
      }
    }
    restoreSelection(selectedObjectIds);
    view.Maximized = viewMaximizationState; // unmaximize view
    return false;
  }


  public bool createTempFlatColorDisplayMode(ref Guid displayModeId){
    string filePathINI = "";
    string guidStr = ""; // we don't really need this, since we get the GUID from the import operation below
    createTempFlatColorINIFile(ref filePathINI, ref guidStr);
    //Print(filePathINI);

    try {
      displayModeId = Rhino.Display.DisplayModeDescription.ImportFromFile(filePathINI);
      removeTempFlatColorINIFile(filePathINI);
      return true;
    } catch (Exception ex){
      Print("createTempDisplayMode exception occurred: " + ex.Message);
      removeTempFlatColorINIFile(filePathINI);
      return false;
    }
  }


  public bool createTempFlatColorINIFile(ref string fPath, ref string guidStr)
  {

    Guid newGuid = Guid.NewGuid(); // Generate a new GUID
    string guidString = newGuid.ToString();
    string str = flatColorDispmodeIniString(guidString);

    string tempPath = Path.GetTempPath(); // Define the path for the .ini file in the temp directory
    string filePath = Path.Combine(tempPath, guidString + ".ini");

    File.WriteAllText(filePath, str); // Write the text into the file

    fPath = filePath; // Output the filepath and the GUID
    guidStr = guidString;
    return true;
  }


  public bool removeTempFlatColorINIFile(string fPath)
  {
    try
    {
      if (File.Exists(fPath))
      {
        File.Delete(fPath);
        return true;
      }
      else { Print(String.Format("removeTempINIFile: file does not exist {0}", fPath)); }
    }
    catch (Exception ex) { Print("removeTempINIFile error: " + ex.Message); }
    return false;
  }


  public string flatColorDispmodeIniString(string guidString)
  {
    string ret = @"[DisplayMode\[[GUID]]]
      SupportsShadeCmd=y
      SupportsShading=y
      SupportsStereo=y
      AddToMenu=y
      AllowObjectAssignment=y
      ShadedPipelineRequired=y
      WireframePipelineRequired=y
      PipelineLocked=n
      Order=10
      DerivedFrom=8bc8debe-c83b-4c47-b13c-9db074510cac
      Name=TEMPORARY
      XrayAllObjects=n
      IgnoreHighlights=n
      DisableConduits=n
      DisableTransparency=n
      BBoxMode=0
      RealtimeDisplayId=00000000-0000-0000-0000-000000000000
      PipelineId=952b2830-ce8a-4b4f-935a-8cd570d162c7
      [DisplayMode\[[GUID]]\View settings]
      UseDocumentGrid=n
      DrawGrid=n
      DrawAxes=n
      DrawZAxis=n
      DrawWorldAxes=n
      ShowGridOnTop=n
      ShowTransGrid=n
      BlendGrid=n
      GridTrans=60
      DrawTransGridPlane=n
      GridPlaneTrans=90
      PlaneVisibility=0
      AxesPercentage=100
      PlaneUsesGridColor=n
      GridPlaneColor=0,0,0
      WorldAxesColor=0
      WxColor=150,75,75
      WyColor=75,150,75
      WzColor=0,0,150
      GroundPlaneUsage=1
      CustomGroundPlaneShow=n
      CustomGroundPlaneAltitude=0
      CustomGroundPlaneAutomaticAltitude=y
      CustomGroundPlaneShadowOnly=y
      LinearWorkflowUsage=1
      CustomLinearWorkflowPreProcessColors=n
      CustomLinearWorkflowPreProcessTextures=n
      CustomLinearWorkflowPostProcessFrameBuffer=n
      CustomLinearWorkflowPreProcessGamma=1
      CustomLinearWorkflowPostProcessGamma=1
      FillMode=2
      SolidColor=0,0,0
      GradTopLeft=200,200,200
      GradBotLeft=140,140,140
      GradTopRight=200,200,200
      GradBotRight=140,140,140
      BackgroundBitmap=
      StereoModeEnabled=0
      StereoSeparation=1
      StereoParallax=1
      AGColorMode=0
      AGViewingMode=0
      FlipGlasses=n
      ShowClippingPlanes=n
      ClippingShowXSurface=y
      ClippingShowXEdges=y
      ClippingClipSelected=y
      ClippingShowCP=y
      ClippingSurfaceUsage=0
      ClippingEdgesUsage=0
      ClippingCPUsage=0
      ClippingCPTrans=95
      ClippingEdgeThickness=3
      ClippingSurfaceColor=128,128,128
      ClippingEdgeColor=0,0,0
      ClippingCPColor=255,255,255
      HorzScale=1
      VertScale=1
      [DisplayMode\[[GUID]]\Shading]
      CullBackfaces=n
      ShadeVertexColors=n
      SingleWireColor=n
      WireColor=0,0,0
      ShadeSurface=y
      UseObjectMaterial=n
      UseObjectBFMaterial=n
      BakeTextures=y
      ShowDecals=y
      SurfaceColorWriting=y
      ShadingEffect=0
      ParallelLineWidth=2
      ParallelLineSeparation=3
      ParallelLineRotation=0
      [DisplayMode\[[GUID]]\Shading\Material]
      UseBackMaterial=y
      FrontIsCustom=n
      BackIsCustom=n
      [DisplayMode\[[GUID]]\Shading\Material\Front Material]
      FlatShaded=n
      OverrideObjectColor=n
      OverrideObjectTransparency=y
      OverrideObjectReflectivity=y
      Diffuse=255,255,255
      Shine=0
      Specular=255,255,255
      Transparency=0
      Reflectivity=0
      ShineIntensity=100
      Luminosity=0
      [DisplayMode\[[GUID]]\Shading\Material\Front Material\EmapTexture]
      Filename=rhino_shaded_mode_emap_background.png
      TextureID=00000000-0000-0000-0000-000000000000
      BlendAmount=0.3
      Mode=3
      Type=86
      WrapU=0
      WrapV=0
      WrapW=0
      MagFilter=1
      MinFilter=1
      TextureOn=y
      Transform=1,0,0,0,0,1,0,0,0,0,1,0,0,0,0,1
      [DisplayMode\[[GUID]]\Shading\Material\Back Material]
      FlatShaded=n
      OverrideObjectColor=y
      OverrideObjectTransparency=y
      OverrideObjectReflectivity=y
      Diffuse=1,1,1
      Shine=0
      Specular=255,255,255
      Transparency=0
      Reflectivity=0
      ShineIntensity=100
      Luminosity=0
      [DisplayMode\[[GUID]]\Lighting]
      ShowLights=n
      UseHiddenLights=n
      UseLightColor=n
      LightingScheme=0
      Luminosity=0
      AmbientColor=25,25,25
      LightCount=3
      Light1Direction=1,5,-15
      Light1Color=190,190,190
      Light1Specular=64,64,64
      Light2Direction=-10,5,2
      Light2Color=128,128,128
      Light2Specular=32,32,32
      Light3Direction=1,-4,0
      Light3Color=128,128,128
      Light3Specular=64,64,64
      CastShadows=n
      ShadowMapSize=2048
      SkylightShadowQuality=4
      NumSamples=4
      ShadowMapType=2
      ShadowBitDepth=32
      ShadowColor=0,0,0
      ShadowIntensity=100
      ShadowBias=10,12,0
      ShadowBlur=0
      TransparencyTolerance=40
      PerPixelLighting=n
      ShadowClippingUsage=0
      ShadowClippingRadius=0
      [DisplayMode\[[GUID]]\Objects]
      CPSolidLines=n
      CPSingleColor=n
      CPHidePoints=n
      CPHideSurface=n
      CPHighlight=y
      CPHidden=n
      nCPWireThickness=1
      nCVSize=3
      eCVStyle=102
      CPColor=0,0,0
      GhostLockedObjects=n
      LockedTrans=50
      LockedUsage=2
      LockedColor=100,100,100
      LockedObjectsBehind=n
      LayersFollowLockUsage=n
      [DisplayMode\[[GUID]]\Objects\Surfaces]
      SurfaceKappaHair=n
      HighlightSurfaces=n
      ShowIsocurves=n
      IsoThicknessUsed=n
      IsocurveThickness=1
      IsoUThickness=1
      IsoVThickness=1
      IsoWThickness=1
      SingleIsoColor=n
      IsoColor=0,0,0
      IsoColorsUsed=n
      IsoUColor=0,0,0
      IsoVColor=0,0,0
      IsoWColor=0,0,0
      IsoPatternUsed=n
      IsocurvePattern=-1
      IsoUPattern=-1
      IsoVPattern=-1
      IsoWPattern=-1
      ShowEdges=y
      ShowNakedEdges=n
      ShowTangentEdges=n
      ShowTangentSeams=n
      ShowNonmanifoldEdges=n
      ShowEdgeEndpoints=n
      EdgeThickness=2
      EdgeColorUsage=0
      NakedEdgeOverride=0
      NakedEdgeThickness=1
      NakedEdgeColorUsage=0
      EdgeColorReduction=0
      NakedEdgeColorReduction=0
      EdgeColor=0,0,0
      NakedEdgeColor=0,0,0
      NonmanifoldEdgeColor=0,0,0
      EdgePattern=-1
      NakedEdgePattern=-1
      NonmanifoldEdgePattern=-1
      [DisplayMode\[[GUID]]\Objects\Meshes]
      HighlightMeshes=n
      SingleMeshWireColor=n
      MeshWireColor=0,0,0
      MeshWireThickness=1
      MeshWirePattern=-1
      ShowMeshWires=n
      ShowMeshVertices=n
      MeshVertexSize=0
      ShowMeshEdges=n
      ShowMeshNakedEdges=n
      ShowMeshNonmanifoldEdges=n
      MeshEdgeThickness=2
      MeshNakedEdgeThickness=2
      MeshNonmanifoldEdgeThickness=0
      MeshEdgeColorReduction=0
      MeshNakedEdgeColorReduction=0
      MeshNonmanifoldEdgeColorReduction=0
      MeshEdgeColor=0,0,0
      MeshNakedEdgeColor=0,0,0
      MeshNonmanifoldEdgeColor=0,0,0
      [DisplayMode\[[GUID]]\Objects\SubD]
      SmoothVisible=n
      SmoothUsage=0
      SmoothColor=255,255,255
      SmoothColorReduction=0
      SmoothThickness=1
      CreaseVisible=n
      CreaseUsage=0
      CreaseColor=255,255,255
      CreaseColorReduction=0
      CreaseThickness=2
      NonmanifoldVisible=n
      NonmanifoldUsage=0
      NonmanifoldColor=255,255,255
      NonmanifoldColorReduction=0
      NonmanifoldThickness=1
      BoundaryVisible=n
      BoundaryUsage=0
      BoundaryColor=255,255,255
      BoundaryColorReduction=0
      BoundaryThickness=2
      ShowReflectedPlane=n
      ShowSymmetryAxis=y
      PlaneColorUsage=2
      SymmetryAxisThickness=0.0625
      ReflectedColor=64,64,64
      ColorPercentage=30
      AxisColor=255,0,0
      [DisplayMode\[[GUID]]\Objects\Curves]
      ShowCurvatureHair=n
      ShowCurves=n
      SingleCurveColor=n
      CurveColor=0,0,0
      CurveThickness=1
      CurveTrans=0
      CurvePattern=-1
      LineEndCapStyle=0
      LineJoinStyle=0
      [DisplayMode\[[GUID]]\Objects\Points]
      PointSize=3
      PointStyle=102
      ShowPoints=n
      ShowPointClouds=n
      PCSize=2
      PCStyle=50
      PCGripSize=2
      PCGripStyle=102
      [DisplayMode\[[GUID]]\Objects\Annotations]
      ShowText=n
      ShowAnnotations=n
      DotTextColor=-1
      DotBorderColor=-1
      [DisplayMode\[[GUID]]\Objects\Technical]
      TechnicalMask=47
      TechnicalUsageMask=0
      THThickness=1
      TEThickness=1
      TSiThickness=1
      TCThickness=1
      TSThickness=1
      TIThickness=1
      THColor=0,0,0
      TEColor=0,0,0
      TSiColor=0,0,0
      TCColor=0,0,0
      TSColor=0,0,0
      TIColor=0,0,0";

    return ret.Replace("[[GUID]]", guidString);
  }

  Rhino.Display.RhinoView getView(string viewName){
    Rhino.RhinoDoc rhinoDoc = Rhino.RhinoDoc.ActiveDoc;
    Rhino.Display.RhinoView namedView = null;

    // Attempt to find a view with the specified name.
    foreach (Rhino.Display.RhinoView view in rhinoDoc.Views)
    {

      if (view.MainViewport.Name.Equals(viewName, StringComparison.CurrentCultureIgnoreCase))
      {
        namedView = view;
        break;
      }
    }

    // If a view with the specified name was found, return it.
    if (namedView != null)
    {

      Print(String.Format("Found a view named {0}", viewName));
      return namedView;
    }
    else
    {
      // If no view with the specified name was found, return the active view.
      Rhino.Display.RhinoView activeView = rhinoDoc.Views.ActiveView;
      if (activeView == null){
        Print(String.Format("Could not find a view named {0}, and could not find ActiveView. No bueno.", viewName));
        return null;
      } else {
        Print(String.Format("Could not find a view named {0}. Falling back to ActiveView.", viewName));
        return activeView;
      }
    }

  }



  public static List<Color> GenerateDistinctColors(int desiredColorCount)
  {
    if (desiredColorCount == 0) return new List<Color>();
    if (desiredColorCount == 1) return new List<Color>{Color.Red};
    if (desiredColorCount == 2) return new List<Color>{Color.Red, Color.Blue};
    if (desiredColorCount == 3) return new List<Color>{Color.Red, Color.Blue, Color.Green};
    if (desiredColorCount == 4) return new List<Color>{Color.Red, Color.Blue, Color.Green, Color.Cyan};
    if (desiredColorCount == 5) return new List<Color>{Color.Red, Color.Blue, Color.Green, Color.Cyan, Color.Magenta};
    if (desiredColorCount == 6) return new List<Color>{Color.Red, Color.Blue, Color.Green, Color.Cyan, Color.Magenta, Color.Yellow};

    double maxSaturation = 1.0;
    double minSaturation = 0.5;
    double maxValue = 0.8;
    double minValue = 0.5;

    int hsvCount = (int) Math.Ceiling(Math.Pow(desiredColorCount, 1.0 / 3)); // cube root of desired count



    double hueInterval = 360.0 / hsvCount;
    double saturationInterval = (maxSaturation - minSaturation) / (hsvCount - 1);
    double valueInterval = (maxValue - minValue) / (hsvCount - 1);

    List<Color> allColors = new List<Color>();
    Random rnd = new Random();

    for (int i = 0; i < hsvCount; i++)
    {
      double hue = i * hueInterval;
      for (int j = 0; j < hsvCount; j++)
      {
        double saturation = minSaturation + j * saturationInterval;
        for (int k = 0; k < hsvCount; k++)
        {
          double value = minValue + k * valueInterval;
          Color color = FromHSV(hue, saturation, value); // Convert HSV to RGB
          allColors.Add(color);
        }
      }
    }

    // Randomly select a subset of colors
    List<Color> selectedColors = new List<Color>();
    while (selectedColors.Count < desiredColorCount && allColors.Count > 0)
    {
      int index = rnd.Next(allColors.Count);
      selectedColors.Add(allColors[index]);
      allColors.RemoveAt(index);
    }

    return selectedColors;
  }

  public static Color FromHSV(double hue, double saturation, double value)
  {
    int hi = Convert.ToInt32(Math.Floor(hue / 60)) % 6;
    double f = hue / 60 - Math.Floor(hue / 60);

    value = value * 255;
    int v = Convert.ToInt32(value);
    int p = Convert.ToInt32(value * (1 - saturation));
    int q = Convert.ToInt32(value * (1 - f * saturation));
    int t = Convert.ToInt32(value * (1 - (1 - f) * saturation));

    if (hi == 0) return Color.FromArgb(255, v, t, p);
    else if (hi == 1) return Color.FromArgb(255, q, v, p);
    else if (hi == 2) return Color.FromArgb(255, p, v, t);
    else if (hi == 3) return Color.FromArgb(255, p, q, v);
    else if (hi == 4) return Color.FromArgb(255, t, p, v);
    else return Color.FromArgb(255, v, p, q);
  }
# ---------- end c_script ----------

# ---- group: depth
c_script_2 = CSharpScript(refresh=button, doSaveLocal=toggle, savepath=panel, viewName="perspective")  # -> out, A; inputs refresh: Boolean, doSaveLocal: Boolean, savepath: String, viewName: String
# ---------- c_script_2: C# usings ----------
using System.Drawing;
using System.IO;
# ---------- c_script_2: C# ----------
    string timestamp = DateTime.Now.ToString("yyMMdd_HHmmss");


    Rhino.Display.RhinoView view = getView(viewName);
    Bitmap bmp = getDepthBitmap(view, 512);
    if (bmp != null){
      A = bmp;
      if (doSaveLocal && savepath != null) bmp.Save(savepath + "\\" + timestamp + "_depth.png", System.Drawing.Imaging.ImageFormat.Png);
    }
    // string desktopPath = Environment.GetFolderPath(Environment.SpecialFolder.Desktop);
    // string filePath = Path.Combine(desktopPath, "depth.png");
    // if (b != null) b.Save(filePath);
# ---------- c_script_2: C# additional code ----------
  Rhino.Display.RhinoView getView(string viewName){
    Rhino.RhinoDoc rhinoDoc = Rhino.RhinoDoc.ActiveDoc;
    Rhino.Display.RhinoView namedView = null;

    // Attempt to find a view with the specified name.
    foreach (Rhino.Display.RhinoView view in rhinoDoc.Views)
    {

      if (view.MainViewport.Name.Equals(viewName, StringComparison.CurrentCultureIgnoreCase))
      {
        namedView = view;
        break;
      }
    }

    // If a view with the specified name was found, return it.
    if (namedView != null)
    {

      Print(String.Format("Found a view named {0}", viewName));
      return namedView;
    }
    else
    {
      // If no view with the specified name was found, return the active view.
      Rhino.Display.RhinoView activeView = rhinoDoc.Views.ActiveView;
      if (activeView == null){
        Print(String.Format("Could not find a view named {0}, and could not find ActiveView. No bueno.", viewName));
        return null;
      } else {
        Print(String.Format("Could not find a view named {0}. Falling back to ActiveView.", viewName));
        return activeView;
      }
    }

  }


  Bitmap getDepthBitmap(Rhino.Display.RhinoView view, int minDim)
  {
    if(view != null)
    {
      // maximize view and test size
      bool viewMaximizationState = view.Maximized;
      view.Maximized = true;
      if (Math.Min(view.Size.Width, view.Size.Height) < minDim){
        Print(String.Format("Viewport too small to meet minDim requirement of {0}. No bueno.", minDim));
        view.Maximized = viewMaximizationState; // unmaximize view
        return null;
      }

      var dmode_rdr = Rhino.Display.DisplayModeDescription.FindByName("Shaded");
      var zcap = new Rhino.Display.ZBufferCapture(view.ActiveViewport);
      zcap.SetDisplayMode(dmode_rdr.Id);
      var bmp = zcap.GrayscaleDib();

      view.Maximized = viewMaximizationState; // unmaximize view


      int smallerDimension = Math.Min(bmp.Width, bmp.Height); // Determine the smaller dimension.
      float scale = (float) minDim / smallerDimension; // Calculate the scale factor.
      int newWidth = (int) (bmp.Width * scale); // Calculate the new dimensions while maintaining the aspect ratio.
      int newHeight = (int) (bmp.Height * scale);
      Bitmap resizedBitmap = new Bitmap(bmp, new Size(newWidth, newHeight)); // Create a new bitmap with the new dimensions.

      Print(String.Format("Created a zBufferCapture of size {0}x{1} resized to {2}x{3}", bmp.Width, bmp.Height, resizedBitmap.Width, resizedBitmap.Height));
      return resizedBitmap;
    }
    else
    {
      Print("Invalid view.");
      return null;
    }
  }
# ---------- end c_script_2 ----------

# ----
panel_2 = Panel(c_script_2.out)
panel_3 = Panel(c_script.out)
panel_4 = Panel(c_script.B)
panel_5 = Panel("a beautiful beautiful golden glowing box next to two apples and a pear with chromatic reflections under studio lighting")
list = ValueList({"depth", "semantic"}, selected="depth")
c_script_3 = CSharpScript(
    doIt=Button(),
    savepath=panel,
    gradioID="6ea4ce91bba5eb1473",
    prompt=panel_5,
    depthBitmap=c_script_2.A,
    semanticBitmap=c_script.A,
    guideSelect=list,
    Reference=["C:\Windows\WinSxS\amd64_system.net.http_b03f5f7f11d50a3a_4.0.15805.0_none_49364fe7559e5a05\System.Net.Http.dll", "C:\Windows\WinSxS\msil_hyperv-ux-ui-newtonsoftjson_31bf3856ad364e35_10.0.19041.1_none_f501448ecc10dc94\Newtonsoft.Json.dll"])  # -> out, A; inputs doIt: Boolean, savepath: String, gradioID: String, prompt: String, guideSelect: String
# ---------- c_script_3: C# usings ----------
using Newtonsoft.Json;
using Newtonsoft.Json.Linq;
using System.Drawing;
using System.IO;
using System.Net.Http;
using System.Text;
# ---------- c_script_3: C# ----------
    Image guideImage;
    string Img2ImgModule;
    string Img2ImgModel;

    if (guideSelect == "depth"){
      guideImage = depthBitmap as Image; // Cast Bitmap to Image.
      Img2ImgModule = "depth";
      Img2ImgModel = "control_v11f1p_sd15_depth [cfd03158]";
    } else if (guideSelect == "semantic"){
      guideImage = semanticBitmap as Image; // Cast Bitmap to Image.
      Img2ImgModule = "none";
      Img2ImgModel = "control_v11p_sd15_seg [e1f51eb9]";
    } else {
      Print("Bad guideSelect");
      return;
    }

    if (doIt){

      string timestamp = DateTime.Now.ToString("yyMMdd_HHmmss");
      string baseURL = "https://" + gradioID + ".gradio.live:443/sdapi";
      string url = baseURL + "/v1/txt2img";

      StringBuilder log = new StringBuilder();
      log.AppendLine(String.Format("baseURL: {0}", baseURL));

      try{

        Automatic1111Script controlNet = BaseControlNetImg2ImgScript(guideImage, Img2ImgModule, Img2ImgModel);

        Automatic1111Payload payload = BasePayload(guideImage.Width, guideImage.Height);
        payload.Prompt = prompt;
        payload.AlwaysonScripts.Add("ControlNet", controlNet);

        string jsonString = JsonConvert.SerializeObject(payload, Formatting.Indented);
        log.AppendLine(String.Format("payload: {0}", jsonString));


        Image img = new Bitmap(256, 256);
        string response = "";
        if (DoPostData(payload, url, ref img, ref response)){
          Print("DoPostData success!");
          img.Save(savepath + "\\" + timestamp + ".png", System.Drawing.Imaging.ImageFormat.Png);
          log.AppendLine(String.Format("response: {0}", response));
        } else {
          Print("DoPostData fail!");
          log.AppendLine(String.Format("response: {0}", response));
        }

      } catch (Exception e) {
        log.AppendLine(String.Format("response: {0}", e.ToString()));

      } finally {

        File.AppendAllText(savepath + "\\" + timestamp + "_log.txt", log.ToString());
      }

    }
# ---------- c_script_3: C# additional code ----------
  static int TIMEOUT = 20;

  bool DoPostData(Automatic1111Payload payload, string url, ref Image img, ref string responseReturn)
  {

    HttpClient client = new HttpClient
      {
        Timeout = TimeSpan.FromSeconds(TIMEOUT)
        };


    var content = new StringContent(JsonConvert.SerializeObject(payload), Encoding.UTF8, "application/json");

    try
    {

      // Make the HTTP request and get the JSON response as a string
      HttpResponseMessage response = client.PostAsync(url, content).Result;
      response.EnsureSuccessStatusCode(); // Ensure the response was successful
      string jsonResponse = response.Content.ReadAsStringAsync().Result;
      responseReturn = jsonResponse;
      JObject json = JObject.Parse(jsonResponse); // Parse the JSON response into a JObject
      JArray imagesArray = (JArray) json["images"]; // Extract the "images" array from the JSON

      // Check if the "images" array is not empty
      if (imagesArray != null && imagesArray.Count > 0)
      {

        string encodedImageData = imagesArray[0].ToString(); // Get the first image data from the "images" array
        byte[] imageDataBytes = Convert.FromBase64String(encodedImageData); // Convert the base64 encoded image data to a byte array

        // Create a MemoryStream to hold the image data
        using (MemoryStream ms = new MemoryStream(imageDataBytes))
        {

          img = Image.FromStream(ms); // Create a System.Drawing.Image object from the MemoryStream
          return true;
        }
      }
      Print("something went bad");
      return false;
    }
    catch (Exception e)
    {
      Print("EXCEPTION!");
      Print(e.ToString());
      responseReturn = e.ToString();
      return false;
    }
  }


  public Automatic1111Script BaseControlNetImg2ImgScript(Image img, string module, string model)
  {
    var controlNet = new Automatic1111Script
      {
        Args = new List<ScriptArgs>
        {
          new ScriptArgs
          {
            InputImage = null,
            Mask = null,
            Module = "", //"depth",
            Model = "", //"control_v11f1p_sd15_depth [cfd03158]",
            Weight = 1.0,
            ResizeMode = "Resize and Fill",
            Lowvram = false,
            ProcessorRes = 512,
            ThresholdA = 64,
            ThresholdB = 64,
            Guidance = 1.0,
            GuidanceStart = 0.0,
            GuidanceEnd = 1.0,
            ControlMode = 0,
            PixelPerfect = false
            }
          }
        };
    controlNet.Args[0].InputImage = img;
    controlNet.Args[0].Module = module;
    controlNet.Args[0].Model = model;


    return controlNet;
  }


  public Automatic1111Payload BasePayload(int width, int height)
  {
    Automatic1111Payload payload = new Automatic1111Payload
      {
        EnableHr = false,
        HrScale = 2,
        HrUpscaler = "Latent",
        HrSecondPassSteps = 0,
        HrResizeX = 0,
        HrResizeY = 0,
        DenoisingStrength = 0.7,
        FirstphaseWidth = 0,
        FirstphaseHeight = 0,
        Prompt = "",
        Styles = new List<object>(),  // or initialize with actual styles if available
        Seed = -1,
        Subseed = -1,
        SubseedStrength = 0.0,
        SeedResizeFromH = 0,
        SeedResizeFromW = 0,
        BatchSize = 1,
        NIter = 1,
        Steps = 20,
        CfgScale = 7,
        Width = -1,
        Height = -1,
        RestoreFaces = false,
        Tiling = false,
        DoNotSaveSamples = false,
        DoNotSaveGrid = false,
        NegativePrompt = "",
        Eta = 1.0,
        SChurn = 0,
        STMax = 0,
        STMin = 0,
        SNoise = 1,
        OverrideSettings = new Dictionary<string, object>(),  // or initialize with actual settings if available
        OverrideSettingsRestoreAfterwards = true,
        SamplerName = "Euler a",
        SamplerIndex = "Euler a",
        ScriptName = null,
        ScriptArgs = new List<object>(),  // or initialize with actual args if available
        SendImages = true,
        SaveImages = false,
        AlwaysonScripts = new Dictionary<string, Automatic1111Script>()
        };

    payload.Width = width;
    payload.Height = height;

    return payload;
  }


  public class Automatic1111Payload
  {
    [JsonProperty("enable_hr")]
    public bool EnableHr { get; set; }

    [JsonProperty("hr_scale")]
    public int HrScale { get; set; }

    [JsonProperty("hr_upscaler")]
    public string HrUpscaler { get; set; }

    [JsonProperty("hr_second_pass_steps")]
    public int HrSecondPassSteps { get; set; }

    [JsonProperty("hr_resize_x")]
    public int HrResizeX { get; set; }

    [JsonProperty("hr_resize_y")]
    public int HrResizeY { get; set; }

    [JsonProperty("denoising_strength")]
    public double DenoisingStrength { get; set; }

    [JsonProperty("firstphase_width")]
    public int FirstphaseWidth { get; set; }

    [JsonProperty("firstphase_height")]
    public int FirstphaseHeight { get; set; }

    [JsonProperty("prompt")]
    public string Prompt { get; set; }

    [JsonProperty("styles")]
    public List<object> Styles { get; set; }

    [JsonProperty("seed")]
    public int Seed { get; set; }

    [JsonProperty("subseed")]
    public int Subseed { get; set; }

    [JsonProperty("subseed_strength")]
    public double SubseedStrength { get; set; }

    [JsonProperty("seed_resize_from_h")]
    public int SeedResizeFromH { get; set; }

    [JsonProperty("seed_resize_from_w")]
    public int SeedResizeFromW { get; set; }

    [JsonProperty("batch_size")]
    public int BatchSize { get; set; }

    [JsonProperty("n_iter")]
    public int NIter { get; set; }

    [JsonProperty("steps")]
    public int Steps { get; set; }

    [JsonProperty("cfg_scale")]
    public int CfgScale { get; set; }

    [JsonProperty("width")]
    public int Width { get; set; }

    [JsonProperty("height")]
    public int Height { get; set; }

    [JsonProperty("restore_faces")]
    public bool RestoreFaces { get; set; }

    [JsonProperty("tiling")]
    public bool Tiling { get; set; }

    [JsonProperty("do_not_save_samples")]
    public bool DoNotSaveSamples { get; set; }

    [JsonProperty("do_not_save_grid")]
    public bool DoNotSaveGrid { get; set; }

    [JsonProperty("negative_prompt")]
    public string NegativePrompt { get; set; }

    [JsonProperty("eta")]
    public double Eta { get; set; }

    [JsonProperty("s_churn")]
    public int SChurn { get; set; }

    [JsonProperty("s_tmax")]
    public int STMax { get; set; }

    [JsonProperty("s_tmin")]
    public int STMin { get; set; }

    [JsonProperty("s_noise")]
    public int SNoise { get; set; }

    [JsonProperty("override_settings")]
    public Dictionary<string, object> OverrideSettings { get; set; }

    [JsonProperty("override_settings_restore_afterwards")]
    public bool OverrideSettingsRestoreAfterwards { get; set; }

    [JsonProperty("sampler_name")]
    public string SamplerName { get; set; }

    [JsonProperty("sampler_index")]
    public string SamplerIndex { get; set; }

    [JsonProperty("script_name")]
    public object ScriptName { get; set; }

    [JsonProperty("script_args")]
    public List<object> ScriptArgs { get; set; }

    [JsonProperty("send_images")]
    public bool SendImages { get; set; }

    [JsonProperty("save_images")]
    public bool SaveImages { get; set; }

    [JsonProperty("alwayson_scripts")]
    public Dictionary<string, Automatic1111Script> AlwaysonScripts { get; set; }
  }

  public class Automatic1111Script
  {
    [JsonProperty("args")]
    public List<ScriptArgs> Args { get; set; }
  }

  public class ScriptArgs
  {

    [JsonProperty("input_image")]
    [JsonConverter(typeof(ImageConverter))]
    public Image InputImage { get; set; }

    [JsonProperty("mask")]
    public object Mask { get; set; }

    [JsonProperty("module")]
    public string Module { get; set; }

    [JsonProperty("model")]
    public string Model { get; set; }

    [JsonProperty("weight")]
    public double Weight { get; set; }

    [JsonProperty("resize_mode")]
    public string ResizeMode { get; set; }

    [JsonProperty("lowvram")]
    public bool Lowvram { get; set; }

    [JsonProperty("processor_res")]
    public int ProcessorRes { get; set; }

    [JsonProperty("threshold_a")]
    public int ThresholdA { get; set; }

    [JsonProperty("threshold_b")]
    public int ThresholdB { get; set; }

    [JsonProperty("guidance")]
    public double Guidance { get; set; }

    [JsonProperty("guidance_start")]
    public double GuidanceStart { get; set; }

    [JsonProperty("guidance_end")]
    public double GuidanceEnd { get; set; }

    [JsonProperty("control_mode")]
    public int ControlMode { get; set; }

    [JsonProperty("pixel_perfect")]
    public bool PixelPerfect { get; set; }
  }


  public class ImageConverter : JsonConverter
  {
    public override bool CanConvert(Type objectType)
    {
      return objectType == typeof(Image);
    }

    public override void WriteJson(JsonWriter writer, object value, JsonSerializer serializer)
    {
      Image image = (Image) value;
      MemoryStream ms = new MemoryStream();
      image.Save(ms, System.Drawing.Imaging.ImageFormat.Png);
      byte[] imageBytes = ms.ToArray();
      string base64String = Convert.ToBase64String(imageBytes);
      writer.WriteValue(base64String);
    }

    public override object ReadJson(JsonReader reader, Type objectType, object existingValue, JsonSerializer serializer)
    {
      string base64String = (string) reader.Value;
      byte[] imageBytes = Convert.FromBase64String(base64String);
      MemoryStream ms = new MemoryStream(imageBytes, 0, imageBytes.Length);
      {
        ms.Write(imageBytes, 0, imageBytes.Length);
        Image image = Image.FromStream(ms, true);
        return image;
      }
    }
  }


  public System.Drawing.Image LoadImage(string imagePath)
  {
    return System.Drawing.Image.FromFile(imagePath);
    /*
    using (FileStream fs = new FileStream(imagePath, FileMode.Open, FileAccess.Read))
    {
      return System.Drawing.Image.FromStream(fs);
    }
    */
  }
# ---------- end c_script_3 ----------
panel_6 = Panel(c_script_3.A)
panel_7 = Panel(c_script_3.out)
