# Grasshopper definition 230923a Replicate Style.gh (Grasshopper 1.0.7)

secret_replicate_token = Panel("r8_dYJMVvMt2jCLngg8czk7CH08uwfh90Y4cC2zo")

# ---- group: paths
pastebin_public_url_no_trailing_slash = Panel("https://stochastic-pastebin.s3.us-west-1.amazonaws.com")
local_savepath = Panel("D:\GitHub\stochastic_2023\_out")
pastebin_api_url_no_trailing_slash = Panel("https://la6k4fgp07.execute-api.us-east-1.amazonaws.com/v1/stochastic-pastebin")

# ---- group: non-semantic prompts
# knolled objects in a professional photoshoot, backdrop, Knolling
panel = Panel("blurry, grainy, jpeg artifacts, low contrast, low quality, lowres, overexposed, oversaturated, plain background, solid background, underexposed, weird colors")
panel_2 = Panel("a professional architectural photograph, chromatic reflections under studio lighting, realistic, photograph, light colors, washed out, ultra hyperdetailed 3D matte painting, ultra hyperrealism, ultra hyperrealistic, cinematic, beauty style, artstation, cgsociety, ultra HD rendering, octane render 8K")
panel_3 = Panel("a cinematic still movie still by wes andersion of a beautiful city by the bay")

# ---- group: set and refresh view
button = Button()
panel_4 = Panel("perspective")

# ----
secret_token = Text(secret_replicate_token)

# ---- group: rendered
c_script = CSharpScript(refresh=button, viewName=panel_4, Reference="D:\GITHUB\STOCHASTIC_2023\230728_GHSERVER\Newtonsoft.Json.dll")  # -> out, A; inputs refresh: Boolean, viewName: String
# ---------- c_script: C# usings ----------
using System.Drawing;
using System.IO;
using Rhino.Display;
# ---------- c_script: C# ----------
    Rhino.Display.RhinoView view = getView(viewName);
    Bitmap bmp = getRenderedBitmap(view, 512);
    A = bmp;

    // string desktopPath = Environment.GetFolderPath(Environment.SpecialFolder.Desktop);
    // string filePath = Path.Combine(desktopPath, "depth.png");
    // if (b != null) b.Save(filePath);
# ---------- c_script: C# additional code ----------
  Rhino.Display.RhinoView getView(string viewName){
    Rhino.RhinoDoc rhinoDoc = Rhino.RhinoDoc.ActiveDoc;
    Rhino.Display.RhinoView namedView = null;

    // Attempt to find a view with the specified name.
    foreach (Rhino.Display.RhinoView view in rhinoDoc.Views)
    {

      if (view.MainViewport.Name.Equals(viewName, StringComparison.CurrentCultureIgnoreCase))
      {
        namedView = view;
        break;
      }
    }

    // If a view with the specified name was found, return it.
    if (namedView != null)
    {

      Print(String.Format("Found a view named {0}", viewName));
      return namedView;
    }
    else
    {
      // If no view with the specified name was found, return the active view.
      Rhino.Display.RhinoView activeView = rhinoDoc.Views.ActiveView;
      if (activeView == null){
        Print(String.Format("Could not find a view named {0}, and could not find ActiveView. No bueno.", viewName));
        return null;
      } else {
        Print(String.Format("Could not find a view named {0}. Falling back to ActiveView.", viewName));
        return activeView;
      }
    }

  }


  Bitmap getRenderedBitmap(Rhino.Display.RhinoView view, int minDim)
  {
    if(view != null)
    {
      // maximize view and test size
      bool viewMaximizationState = view.Maximized;
      view.Maximized = true;
      if (Math.Min(view.Size.Width, view.Size.Height) < minDim){
        Print(String.Format("Viewport too small to meet minDim requirement of {0}. No bueno.", minDim));
        view.Maximized = viewMaximizationState; // unmaximize view
        return null;
      }

      var dmode_rdr = Rhino.Display.DisplayModeDescription.FindByName("Rendered");
      //ViewCaptureSettings settings = new ViewCaptureSettings(view, new Size(view.Size.Width, view.Size.Height), 300.0);
      //settings.DisplayMode = dmode_rdr;
      //Bitmap bmp = ViewCapture.CaptureToBitmap(settings);
      Bitmap bmp = view.CaptureToBitmap(new Size(view.Size.Width, view.Size.Height), dmode_rdr);

      view.Maximized = viewMaximizationState; // unmaximize view


      int smallerDimension = Math.Min(bmp.Width, bmp.Height); // Determine the smaller dimension.
      float scale = (float) minDim / smallerDimension; // Calculate the scale factor.
      int newWidth = (int) (bmp.Width * scale); // Calculate the new dimensions while maintaining the aspect ratio.
      int newHeight = (int) (bmp.Height * scale);
      Bitmap resizedBitmap = new Bitmap(bmp, new Size(newWidth, newHeight)); // Create a new bitmap with the new dimensions.

      Print(String.Format("Created a ViewCapture of size {0}x{1} resized to {2}x{3}", bmp.Width, bmp.Height, resizedBitmap.Width, resizedBitmap.Height));
      return resizedBitmap;
    }
    else
    {
      Print("Invalid view.");
      return null;
    }
  }
# ---------- end c_script ----------

# ---- group: semantic
c_script_2 = CSharpScript(refresh=button, viewName=panel_4, Reference="D:\GITHUB\STOCHASTIC_2023\230728_GHSERVER\Newtonsoft.Json.dll")  # -> out, A, B; inputs refresh: Boolean, viewName: String
# ---------- c_script_2: C# usings ----------
using System.IO;
using System.Drawing;
using Rhino.DocObjects;
using System.Collections.Specialized;
using Newtonsoft.Json;
using System.Text;
# ---------- c_script_2: C# ----------
    Color promptlessColor = System.Drawing.Color.FromArgb(255, 10, 10, 10);
    string promptKey = "prompt";



    var doc = RhinoDoc.ActiveDoc;

    // Iterate over every object in the Rhino model and store its ObjectColor and ColorSource
    // Set all displaycolors to the promptless color
    Dictionary<Guid, Tuple<Color, ObjectColorSource>> colorSettings = new Dictionary<Guid, Tuple<Color, ObjectColorSource>>();
    foreach (var rhinoObject in doc.Objects)
    {
      colorSettings[rhinoObject.Id] = Tuple.Create(rhinoObject.Attributes.ObjectColor, rhinoObject.Attributes.ColorSource);
      rhinoObject.Attributes.ColorSource = ObjectColorSource.ColorFromObject;
      rhinoObject.Attributes.ObjectColor = promptlessColor;
      rhinoObject.CommitChanges();
    }

    Dictionary<Color, Tuple<string, List<Guid>>> promptDict = generatePromptDict(promptKey);
    string jsonString = promptDictToString(promptDict);
    B = jsonString;

    // Iterate over each prompt and change the ObjectColor of all related objects
    foreach (KeyValuePair<Color, Tuple<string, List<Guid>>> entry in promptDict)
    {
      Color color = entry.Key;
      string prompt = entry.Value.Item1;
      foreach (Guid guid in entry.Value.Item2)
      {
        RhinoObject rhinoObject = doc.Objects.Find(guid);
        if (rhinoObject != null){
          rhinoObject.Attributes.ObjectColor = color;
          rhinoObject.CommitChanges();
        }
      }
    }
    doc.Views.Redraw(); // Make sure changes are redrawn


    // Capture Bitmap
    Rhino.Display.RhinoView view = getView(viewName);
    if (view == null) return;

    Bitmap bmp = null;
    if (doCaptureFlatColorBitmap(view, ref bmp, 512)){
      A = bmp;
    }


    // Iterate over each object and restore the previous settings
    foreach (var rhinoObject in doc.Objects)
    {
      if (colorSettings.ContainsKey(rhinoObject.Id))
      {
        var colorSetting = colorSettings[rhinoObject.Id];
        rhinoObject.Attributes.ObjectColor = colorSetting.Item1;
        rhinoObject.Attributes.ColorSource = colorSetting.Item2;
        rhinoObject.CommitChanges();
      }
    }


    doc.Views.Redraw(); // Make sure changes are redrawn
# ---------- c_script_2: C# additional code ----------
  public Dictionary<Color, Tuple<string, List<Guid>>> generatePromptDict(string promptKey){

    // Collect all prompts and related objects
    Dictionary<string, List<Guid>> promptDict = new Dictionary<string, List<Guid>>();
    foreach (var rhinoObject in doc.Objects)
    {
      NameValueCollection userStrings = rhinoObject.Attributes.GetUserStrings(); // Get the user strings
      string promptStr = userStrings.Get(promptKey);
      if (promptStr != null){ // if this object has an associated prompt
        if (promptDict.ContainsKey(promptStr)) promptDict[promptStr].Add(rhinoObject.Id);
        else promptDict[promptStr] = new List<Guid>() { rhinoObject.Id };
      }
    }
    Print(String.Format("Found {0} unique prompts", promptDict.Count));
    List<Color> colors = GenerateDistinctColors(promptDict.Count);

    // construct result
    Dictionary<Color, Tuple<string, List<Guid>>> result = new Dictionary<Color, Tuple<string, List<Guid>>>();
    int colorIndex = 0;
    foreach (var entry in promptDict)
    {
      result[colors[colorIndex++]] = new Tuple<string, List<Guid>>(entry.Key, entry.Value);
    }

    return result;

  }

  public string promptDictToString(Dictionary<Color, Tuple<string, List<Guid>>> promptDict)
  {
    StringBuilder sb = new StringBuilder();
    foreach (var item in promptDict)
    {
      Color color = item.Key;
      string colorString = string.Format("{{{0},{1},{2}}} ", color.R, color.G, color.B);
      string text = item.Value.Item1;

      sb.Append(colorString);
      sb.Append(text);
      sb.Append(" |");
    }

    if (sb.Length > 0) { sb.Length--; } // Remove the last pipe if it exists

    return sb.ToString();

  }

  public string promptDictToJsonString(Dictionary<Color, Tuple<string, List<Guid>>> promptDict)
  {
    // Construct a list of dictionaries
    List<Dictionary<string, object>> dictList = new List<Dictionary<string, object>>();
    foreach (var entry in promptDict)
    {
      Dictionary<string, object> dict = new Dictionary<string, object>();
      dict.Add("color", new List<int> { entry.Key.R, entry.Key.G, entry.Key.B });
      dict.Add("prompt", entry.Value.Item1);
      dictList.Add(dict);
    }
    string jsonString = JsonConvert.SerializeObject(dictList, Formatting.Indented); // Convert the dictionary to a JSON string
    return jsonString;

  }


  public void restoreSelection(List<Guid> selectedObjectIds){
    // Restore the previous selection
    foreach (var id in selectedObjectIds)
    {
      var obj = RhinoDoc.ActiveDoc.Objects.Find(id);
      if (obj != null)obj.Select(true);
    }
    RhinoDoc.ActiveDoc.Views.Redraw();
  }

  public bool doCaptureFlatColorBitmap(Rhino.Display.RhinoView view, ref Bitmap bitmap, int minDim){

    // maximize view and test size
    bool viewMaximizationState = view.Maximized;
    view.Maximized = true;
    if (Math.Min(view.Size.Width, view.Size.Height) < minDim){
      Print(String.Format("Viewport too small to meet minDim requirement of {0}. No bueno.", minDim));
      view.Maximized = viewMaximizationState; // unmaximize view
      return false;
    }

    // Save all selected objects and deselect
    List<Guid> selectedObjectIds = new List<Guid>();
    foreach (var obj in RhinoDoc.ActiveDoc.Objects.GetSelectedObjects(false, false)) selectedObjectIds.Add(obj.Id);
    RhinoDoc.ActiveDoc.Objects.UnselectAll(); // Deselect all objects

    Guid userDisplayModeId = view.ActiveViewport.DisplayMode.Id;

    Guid displayModeId = new Guid();
    if (createTempFlatColorDisplayMode(ref displayModeId)){
      try {
        //Print(String.Format("Capturing view with temporary displaymode {0}", displayModeId.ToString()));
        view.ActiveViewport.DisplayMode = Rhino.Display.DisplayModeDescription.GetDisplayMode(displayModeId);
        Rhino.Display.DisplayModeDescription dispModeDescription = Rhino.Display.DisplayModeDescription.GetDisplayMode(displayModeId);
        Bitmap bmp = view.CaptureToBitmap(view.Size, dispModeDescription);
        if (bmp != null){
          restoreSelection(selectedObjectIds);
          view.Maximized = viewMaximizationState; // unmaximize view

          int smallerDimension = Math.Min(bmp.Width, bmp.Height); // Determine the smaller dimension.
          float scale = (float) minDim / smallerDimension; // Calculate the scale factor.
          int newWidth = (int) (bmp.Width * scale); // Calculate the new dimensions while maintaining the aspect ratio.
          int newHeight = (int) (bmp.Height * scale);
          Bitmap resizedBitmap = new Bitmap(bmp, new Size(newWidth, newHeight)); // Create a new bitmap with the new dimensions.

          Print(String.Format("Created a semanticMap of size {0}x{1} resized to {2}x{3}", bmp.Width, bmp.Height, resizedBitmap.Width, resizedBitmap.Height));
          bitmap = resizedBitmap;

          return true;
        }
        Print("doCaptureFlatColorBitmap: Bitmap was null");
      } catch (Exception ex) {
        Print("A main function exception occurred: " + ex.Message);
      } finally {
        view.ActiveViewport.DisplayMode = Rhino.Display.DisplayModeDescription.GetDisplayMode(userDisplayModeId);
        Rhino.Display.DisplayModeDescription.DeleteDisplayMode(displayModeId);
      }
    }
    restoreSelection(selectedObjectIds);
    view.Maximized = viewMaximizationState; // unmaximize view
    return false;
  }


  public bool createTempFlatColorDisplayMode(ref Guid displayModeId){
    string filePathINI = "";
    string guidStr = ""; // we don't really need this, since we get the GUID from the import operation below
    createTempFlatColorINIFile(ref filePathINI, ref guidStr);
    //Print(filePathINI);

    try {
      displayModeId = Rhino.Display.DisplayModeDescription.ImportFromFile(filePathINI);
      removeTempFlatColorINIFile(filePathINI);
      return true;
    } catch (Exception ex){
      Print("createTempDisplayMode exception occurred: " + ex.Message);
      removeTempFlatColorINIFile(filePathINI);
      return false;
    }
  }


  public bool createTempFlatColorINIFile(ref string fPath, ref string guidStr)
  {

    Guid newGuid = Guid.NewGuid(); // Generate a new GUID
    string guidString = newGuid.ToString();
    string str = flatColorDispmodeIniString(guidString);

    string tempPath = Path.GetTempPath(); // Define the path for the .ini file in the temp directory
    string filePath = Path.Combine(tempPath, guidString + ".ini");

    File.WriteAllText(filePath, str); // Write the text into the file

    fPath = filePath; // Output the filepath and the GUID
    guidStr = guidString;
    return true;
  }


  public bool removeTempFlatColorINIFile(string fPath)
  {
    try
    {
      if (File.Exists(fPath))
      {
        File.Delete(fPath);
        return true;
      }
      else { Print(String.Format("removeTempINIFile: file does not exist {0}", fPath)); }
    }
    catch (Exception ex) { Print("removeTempINIFile error: " + ex.Message); }
    return false;
  }


  public string flatColorDispmodeIniString(string guidString)
  {
    string ret = @"[DisplayMode\[[GUID]]]
      SupportsShadeCmd=y
      SupportsShading=y
      SupportsStereo=y
      AddToMenu=y
      AllowObjectAssignment=y
      ShadedPipelineRequired=y
      WireframePipelineRequired=y
      PipelineLocked=n
      Order=10
      DerivedFrom=8bc8debe-c83b-4c47-b13c-9db074510cac
      Name=TEMPORARY
      XrayAllObjects=n
      IgnoreHighlights=n
      DisableConduits=n
      DisableTransparency=n
      BBoxMode=0
      RealtimeDisplayId=00000000-0000-0000-0000-000000000000
      PipelineId=952b2830-ce8a-4b4f-935a-8cd570d162c7
      [DisplayMode\[[GUID]]\View settings]
      UseDocumentGrid=n
      DrawGrid=n
      DrawAxes=n
      DrawZAxis=n
      DrawWorldAxes=n
      ShowGridOnTop=n
      ShowTransGrid=n
      BlendGrid=n
      GridTrans=60
      DrawTransGridPlane=n
      GridPlaneTrans=90
      PlaneVisibility=0
      AxesPercentage=100
      PlaneUsesGridColor=n
      GridPlaneColor=0,0,0
      WorldAxesColor=0
      WxColor=150,75,75
      WyColor=75,150,75
      WzColor=0,0,150
      GroundPlaneUsage=1
      CustomGroundPlaneShow=n
      CustomGroundPlaneAltitude=0
      CustomGroundPlaneAutomaticAltitude=y
      CustomGroundPlaneShadowOnly=y
      LinearWorkflowUsage=1
      CustomLinearWorkflowPreProcessColors=n
      CustomLinearWorkflowPreProcessTextures=n
      CustomLinearWorkflowPostProcessFrameBuffer=n
      CustomLinearWorkflowPreProcessGamma=1
      CustomLinearWorkflowPostProcessGamma=1
      FillMode=2
      SolidColor=0,0,0
      GradTopLeft=200,200,200
      GradBotLeft=140,140,140
      GradTopRight=200,200,200
      GradBotRight=140,140,140
      BackgroundBitmap=
      StereoModeEnabled=0
      StereoSeparation=1
      StereoParallax=1
      AGColorMode=0
      AGViewingMode=0
      FlipGlasses=n
      ShowClippingPlanes=n
      ClippingShowXSurface=y
      ClippingShowXEdges=y
      ClippingClipSelected=y
      ClippingShowCP=y
      ClippingSurfaceUsage=0
      ClippingEdgesUsage=0
      ClippingCPUsage=0
      ClippingCPTrans=95
      ClippingEdgeThickness=3
      ClippingSurfaceColor=128,128,128
      ClippingEdgeColor=0,0,0
      ClippingCPColor=255,255,255
      HorzScale=1
      VertScale=1
      [DisplayMode\[[GUID]]\Shading]
      CullBackfaces=n
      ShadeVertexColors=n
      SingleWireColor=n
      WireColor=0,0,0
      ShadeSurface=y
      UseObjectMaterial=n
      UseObjectBFMaterial=n
      BakeTextures=y
      ShowDecals=y
      SurfaceColorWriting=y
      ShadingEffect=0
      ParallelLineWidth=2
      ParallelLineSeparation=3
      ParallelLineRotation=0
      [DisplayMode\[[GUID]]\Shading\Material]
      UseBackMaterial=y
      FrontIsCustom=n
      BackIsCustom=n
      [DisplayMode\[[GUID]]\Shading\Material\Front Material]
      FlatShaded=n
      OverrideObjectColor=n
      OverrideObjectTransparency=y
      OverrideObjectReflectivity=y
      Diffuse=255,255,255
      Shine=0
      Specular=255,255,255
      Transparency=0
      Reflectivity=0
      ShineIntensity=100
      Luminosity=0
      [DisplayMode\[[GUID]]\Shading\Material\Front Material\EmapTexture]
      Filename=rhino_shaded_mode_emap_background.png
      TextureID=00000000-0000-0000-0000-000000000000
      BlendAmount=0.3
      Mode=3
      Type=86
      WrapU=0
      WrapV=0
      WrapW=0
      MagFilter=1
      MinFilter=1
      TextureOn=y
      Transform=1,0,0,0,0,1,0,0,0,0,1,0,0,0,0,1
      [DisplayMode\[[GUID]]\Shading\Material\Back Material]
      FlatShaded=n
      OverrideObjectColor=n
      OverrideObjectTransparency=y
      OverrideObjectReflectivity=y
      Diffuse=1,1,1
      Shine=0
      Specular=255,255,255
      Transparency=0
      Reflectivity=0
      ShineIntensity=100
      Luminosity=0
      [DisplayMode\[[GUID]]\Lighting]
      ShowLights=n
      UseHiddenLights=n
      UseLightColor=n
      LightingScheme=0
      Luminosity=0
      AmbientColor=25,25,25
      LightCount=3
      Light1Direction=1,5,-15
      Light1Color=190,190,190
      Light1Specular=64,64,64
      Light2Direction=-10,5,2
      Light2Color=128,128,128
      Light2Specular=32,32,32
      Light3Direction=1,-4,0
      Light3Color=128,128,128
      Light3Specular=64,64,64
      CastShadows=n
      ShadowMapSize=2048
      SkylightShadowQuality=4
      NumSamples=4
      ShadowMapType=2
      ShadowBitDepth=32
      ShadowColor=0,0,0
      ShadowIntensity=100
      ShadowBias=10,12,0
      ShadowBlur=0
      TransparencyTolerance=40
      PerPixelLighting=n
      ShadowClippingUsage=0
      ShadowClippingRadius=0
      [DisplayMode\[[GUID]]\Objects]
      CPSolidLines=n
      CPSingleColor=n
      CPHidePoints=n
      CPHideSurface=n
      CPHighlight=y
      CPHidden=n
      nCPWireThickness=1
      nCVSize=3
      eCVStyle=102
      CPColor=0,0,0
      GhostLockedObjects=n
      LockedTrans=50
      LockedUsage=2
      LockedColor=100,100,100
      LockedObjectsBehind=n
      LayersFollowLockUsage=n
      [DisplayMode\[[GUID]]\Objects\Surfaces]
      SurfaceKappaHair=n
      HighlightSurfaces=n
      ShowIsocurves=n
      IsoThicknessUsed=n
      IsocurveThickness=1
      IsoUThickness=1
      IsoVThickness=1
      IsoWThickness=1
      SingleIsoColor=n
      IsoColor=0,0,0
      IsoColorsUsed=n
      IsoUColor=0,0,0
      IsoVColor=0,0,0
      IsoWColor=0,0,0
      IsoPatternUsed=n
      IsocurvePattern=-1
      IsoUPattern=-1
      IsoVPattern=-1
      IsoWPattern=-1
      ShowEdges=y
      ShowNakedEdges=n
      ShowTangentEdges=n
      ShowTangentSeams=n
      ShowNonmanifoldEdges=n
      ShowEdgeEndpoints=n
      EdgeThickness=2
      EdgeColorUsage=0
      NakedEdgeOverride=0
      NakedEdgeThickness=1
      NakedEdgeColorUsage=0
      EdgeColorReduction=0
      NakedEdgeColorReduction=0
      EdgeColor=0,0,0
      NakedEdgeColor=0,0,0
      NonmanifoldEdgeColor=0,0,0
      EdgePattern=-1
      NakedEdgePattern=-1
      NonmanifoldEdgePattern=-1
      [DisplayMode\[[GUID]]\Objects\Meshes]
      HighlightMeshes=n
      SingleMeshWireColor=n
      MeshWireColor=0,0,0
      MeshWireThickness=1
      MeshWirePattern=-1
      ShowMeshWires=n
      ShowMeshVertices=n
      MeshVertexSize=0
      ShowMeshEdges=n
      ShowMeshNakedEdges=n
      ShowMeshNonmanifoldEdges=n
      MeshEdgeThickness=2
      MeshNakedEdgeThickness=2
      MeshNonmanifoldEdgeThickness=0
      MeshEdgeColorReduction=0
      MeshNakedEdgeColorReduction=0
      MeshNonmanifoldEdgeColorReduction=0
      MeshEdgeColor=0,0,0
      MeshNakedEdgeColor=0,0,0
      MeshNonmanifoldEdgeColor=0,0,0
      [DisplayMode\[[GUID]]\Objects\SubD]
      SmoothVisible=n
      SmoothUsage=0
      SmoothColor=255,255,255
      SmoothColorReduction=0
      SmoothThickness=1
      CreaseVisible=n
      CreaseUsage=0
      CreaseColor=255,255,255
      CreaseColorReduction=0
      CreaseThickness=2
      NonmanifoldVisible=n
      NonmanifoldUsage=0
      NonmanifoldColor=255,255,255
      NonmanifoldColorReduction=0
      NonmanifoldThickness=1
      BoundaryVisible=n
      BoundaryUsage=0
      BoundaryColor=255,255,255
      BoundaryColorReduction=0
      BoundaryThickness=2
      ShowReflectedPlane=n
      ShowSymmetryAxis=y
      PlaneColorUsage=2
      SymmetryAxisThickness=0.0625
      ReflectedColor=64,64,64
      ColorPercentage=30
      AxisColor=255,0,0
      [DisplayMode\[[GUID]]\Objects\Curves]
      ShowCurvatureHair=n
      ShowCurves=n
      SingleCurveColor=n
      CurveColor=0,0,0
      CurveThickness=1
      CurveTrans=0
      CurvePattern=-1
      LineEndCapStyle=0
      LineJoinStyle=0
      [DisplayMode\[[GUID]]\Objects\Points]
      PointSize=3
      PointStyle=102
      ShowPoints=n
      ShowPointClouds=n
      PCSize=2
      PCStyle=50
      PCGripSize=2
      PCGripStyle=102
      [DisplayMode\[[GUID]]\Objects\Annotations]
      ShowText=n
      ShowAnnotations=n
      DotTextColor=-1
      DotBorderColor=-1
      [DisplayMode\[[GUID]]\Objects\Technical]
      TechnicalMask=47
      TechnicalUsageMask=0
      THThickness=1
      TEThickness=1
      TSiThickness=1
      TCThickness=1
      TSThickness=1
      TIThickness=1
      THColor=0,0,0
      TEColor=0,0,0
      TSiColor=0,0,0
      TCColor=0,0,0
      TSColor=0,0,0
      TIColor=0,0,0";

    return ret.Replace("[[GUID]]", guidString);
  }

  Rhino.Display.RhinoView getView(string viewName){
    Rhino.RhinoDoc rhinoDoc = Rhino.RhinoDoc.ActiveDoc;
    Rhino.Display.RhinoView namedView = null;

    // Attempt to find a view with the specified name.
    foreach (Rhino.Display.RhinoView view in rhinoDoc.Views)
    {

      if (view.MainViewport.Name.Equals(viewName, StringComparison.CurrentCultureIgnoreCase))
      {
        namedView = view;
        break;
      }
    }

    // If a view with the specified name was found, return it.
    if (namedView != null)
    {

      Print(String.Format("Found a view named {0}", viewName));
      return namedView;
    }
    else
    {
      // If no view with the specified name was found, return the active view.
      Rhino.Display.RhinoView activeView = rhinoDoc.Views.ActiveView;
      if (activeView == null){
        Print(String.Format("Could not find a view named {0}, and could not find ActiveView. No bueno.", viewName));
        return null;
      } else {
        Print(String.Format("Could not find a view named {0}. Falling back to ActiveView.", viewName));
        return activeView;
      }
    }

  }



  public static List<Color> GenerateDistinctColors(int desiredColorCount)
  {
    if (desiredColorCount == 0) return new List<Color>();
    if (desiredColorCount == 1) return new List<Color>{Color.Red};
    if (desiredColorCount == 2) return new List<Color>{Color.Red, Color.Blue};
    if (desiredColorCount == 3) return new List<Color>{Color.Red, Color.Blue, Color.Green};
    if (desiredColorCount == 4) return new List<Color>{Color.Red, Color.Blue, Color.Green, Color.Cyan};
    if (desiredColorCount == 5) return new List<Color>{Color.Red, Color.Blue, Color.Green, Color.Cyan, Color.Magenta};
    if (desiredColorCount == 6) return new List<Color>{Color.Red, Color.Blue, Color.Green, Color.Cyan, Color.Magenta, Color.Yellow};

    double maxSaturation = 1.0;
    double minSaturation = 0.5;
    double maxValue = 0.8;
    double minValue = 0.5;

    int hsvCount = (int) Math.Ceiling(Math.Pow(desiredColorCount, 1.0 / 3)); // cube root of desired count



    double hueInterval = 360.0 / hsvCount;
    double saturationInterval = (maxSaturation - minSaturation) / (hsvCount - 1);
    double valueInterval = (maxValue - minValue) / (hsvCount - 1);

    List<Color> allColors = new List<Color>();
    Random rnd = new Random();

    for (int i = 0; i < hsvCount; i++)
    {
      double hue = i * hueInterval;
      for (int j = 0; j < hsvCount; j++)
      {
        double saturation = minSaturation + j * saturationInterval;
        for (int k = 0; k < hsvCount; k++)
        {
          double value = minValue + k * valueInterval;
          Color color = FromHSV(hue, saturation, value); // Convert HSV to RGB
          allColors.Add(color);
        }
      }
    }

    // Randomly select a subset of colors
    List<Color> selectedColors = new List<Color>();
    while (selectedColors.Count < desiredColorCount && allColors.Count > 0)
    {
      int index = rnd.Next(allColors.Count);
      selectedColors.Add(allColors[index]);
      allColors.RemoveAt(index);
    }

    return selectedColors;
  }

  public static Color FromHSV(double hue, double saturation, double value)
  {
    int hi = Convert.ToInt32(Math.Floor(hue / 60)) % 6;
    double f = hue / 60 - Math.Floor(hue / 60);

    value = value * 255;
    int v = Convert.ToInt32(value);
    int p = Convert.ToInt32(value * (1 - saturation));
    int q = Convert.ToInt32(value * (1 - f * saturation));
    int t = Convert.ToInt32(value * (1 - (1 - f) * saturation));

    if (hi == 0) return Color.FromArgb(255, v, t, p);
    else if (hi == 1) return Color.FromArgb(255, q, v, p);
    else if (hi == 2) return Color.FromArgb(255, p, v, t);
    else if (hi == 3) return Color.FromArgb(255, p, q, v);
    else if (hi == 4) return Color.FromArgb(255, t, p, v);
    else return Color.FromArgb(255, v, p, q);
  }
# ---------- end c_script_2 ----------

# ---- group: depth
c_script_3 = CSharpScript(refresh=button, viewName=panel_4, Reference="D:\GITHUB\STOCHASTIC_2023\230728_GHSERVER\Newtonsoft.Json.dll")  # -> out, A; inputs refresh: Boolean, viewName: String
# ---------- c_script_3: C# usings ----------
using System.Drawing;
using System.IO;
# ---------- c_script_3: C# ----------
    


    Rhino.Display.RhinoView view = getView(viewName);
    Bitmap bmp = getDepthBitmap(view, 512);
    A = bmp;

    // string desktopPath = Environment.GetFolderPath(Environment.SpecialFolder.Desktop);
    // string filePath = Path.Combine(desktopPath, "depth.png");
    // if (b != null) b.Save(filePath);
# ---------- c_script_3: C# additional code ----------
  Rhino.Display.RhinoView getView(string viewName){
    Rhino.RhinoDoc rhinoDoc = Rhino.RhinoDoc.ActiveDoc;
    Rhino.Display.RhinoView namedView = null;

    // Attempt to find a view with the specified name.
    foreach (Rhino.Display.RhinoView view in rhinoDoc.Views)
    {

      if (view.MainViewport.Name.Equals(viewName, StringComparison.CurrentCultureIgnoreCase))
      {
        namedView = view;
        break;
      }
    }

    // If a view with the specified name was found, return it.
    if (namedView != null)
    {

      Print(String.Format("Found a view named {0}", viewName));
      return namedView;
    }
    else
    {
      // If no view with the specified name was found, return the active view.
      Rhino.Display.RhinoView activeView = rhinoDoc.Views.ActiveView;
      if (activeView == null){
        Print(String.Format("Could not find a view named {0}, and could not find ActiveView. No bueno.", viewName));
        return null;
      } else {
        Print(String.Format("Could not find a view named {0}. Falling back to ActiveView.", viewName));
        return activeView;
      }
    }

  }


  Bitmap getDepthBitmap(Rhino.Display.RhinoView view, int minDim)
  {
    if(view != null)
    {
      // maximize view and test size
      bool viewMaximizationState = view.Maximized;
      view.Maximized = true;
      if (Math.Min(view.Size.Width, view.Size.Height) < minDim){
        Print(String.Format("Viewport too small to meet minDim requirement of {0}. No bueno.", minDim));
        view.Maximized = viewMaximizationState; // unmaximize view
        return null;
      }

      var dmode_rdr = Rhino.Display.DisplayModeDescription.FindByName("Shaded");
      var zcap = new Rhino.Display.ZBufferCapture(view.ActiveViewport);
      zcap.SetDisplayMode(dmode_rdr.Id);
      var bmp = zcap.GrayscaleDib();

      view.Maximized = viewMaximizationState; // unmaximize view


      int smallerDimension = Math.Min(bmp.Width, bmp.Height); // Determine the smaller dimension.
      float scale = (float) minDim / smallerDimension; // Calculate the scale factor.
      int newWidth = (int) (bmp.Width * scale); // Calculate the new dimensions while maintaining the aspect ratio.
      int newHeight = (int) (bmp.Height * scale);
      Bitmap resizedBitmap = new Bitmap(bmp, new Size(newWidth, newHeight)); // Create a new bitmap with the new dimensions.

      Print(String.Format("Created a zBufferCapture of size {0}x{1} resized to {2}x{3}", bmp.Width, bmp.Height, resizedBitmap.Width, resizedBitmap.Height));
      return resizedBitmap;
    }
    else
    {
      Print("Invalid view.");
      return null;
    }
  }
# ---------- end c_script_3 ----------

# ----
panel_5 = Panel(c_script.out)
panel_6 = Panel(c_script_2.out)
panel_7 = Panel(c_script_3.out)

# ---- group: combines prompts
c_script_4 = CSharpScript(
    semanticMapString=c_script_2.B,
    stylePrompt=panel_2,
    outpaintingPrompt=panel_3,
    negativePrompt=panel,
    Reference="D:\GITHUB\STOCHASTIC_2023\230728_GHSERVER\Newtonsoft.Json.dll")  # -> out, A; inputs semanticMapString: String, stylePrompt: String, outpaintingPrompt: String, negativePrompt: String
# ---------- c_script_4: C# usings ----------
using Newtonsoft.Json;
using Newtonsoft.Json.Linq;
# ---------- c_script_4: C# ----------
    var result = new JObject();
    result.Add("pmt_style", stylePrompt);
    result.Add("pmt_outpaint", outpaintingPrompt);
    result.Add("pmt_negative", negativePrompt);
    result.Add("map_semantic_str", semanticMapString);

    A = result.ToString(Newtonsoft.Json.Formatting.Indented);
# ---------- end c_script_4 ----------

# ----
random_seed = Panel("2")
c_script_5 = CSharpScript(
    strJSON=c_script_4.A,
    seed=random_seed,
    numInferenceStepsInpaint=Slider(20, range=2..40),
    numInferenceStepsOutpaint=Slider(10, range=2..40),
    controlnetConditioningScaleInpaint=Slider(0.7, range=0..1),
    controlGuidanceEndInpaint=Slider(0.3, range=0..1),
    Reference="D:\GITHUB\STOCHASTIC_2023\230728_GHSERVER\Newtonsoft.Json.dll")  # -> out, A; inputs strJSON: String, seed: Int32, numInferenceStepsInpaint: Int32, numInferenceStepsOutpaint: Int32, noisinessImgBase: Double, strengthInpaint: Double, strengthOutpaint: Double, controlnetConditioningScaleInpaint: Double, controlnetConditioningScaleOutpaint: Double, controlGuidanceEndInpaint: Double, controlGuidanceEndOutpaint: Double, guidanceScaleInpaint: Double, guidanceScaleOutpaint: Double
# ---------- c_script_5: C# ----------
    var payload = JObject.Parse(strJSON); // Parse the JSON string

    if (numInferenceStepsInpaint == 0) numInferenceStepsInpaint = 10;
    if (numInferenceStepsOutpaint == 0) numInferenceStepsOutpaint = 3;

    if (noisinessImgBase == 0.0) noisinessImgBase = 0.5;

    if (strengthInpaint == 0.0) strengthInpaint = 1.0;
    if (strengthOutpaint == 0.0) strengthOutpaint = 1.0;

    if (controlnetConditioningScaleInpaint == 0.0) controlnetConditioningScaleInpaint = 1.0;
    if (controlnetConditioningScaleOutpaint == 0.0) controlnetConditioningScaleOutpaint = 1.0;

    if (controlGuidanceEndInpaint == 0.0) controlGuidanceEndInpaint = 1.0;
    if (controlGuidanceEndOutpaint == 0.0) controlGuidanceEndOutpaint = 1.0;

    if (guidanceScaleInpaint == 0.0) guidanceScaleInpaint = 8.0;
    if (guidanceScaleOutpaint == 0.0) guidanceScaleOutpaint = 8.0;

    payload.Add("seed", seed);
    payload.Add("num_inference_steps_inpaint", numInferenceStepsInpaint);
    payload.Add("num_inference_steps_outpaint", numInferenceStepsOutpaint);
    payload.Add("noisiness_img_base", noisinessImgBase);
    payload.Add("strength_inpaint", strengthInpaint);
    payload.Add("strength_outpaint", strengthOutpaint);
    payload.Add("controlnet_conditioning_scale_inpaint", controlnetConditioningScaleInpaint);
    payload.Add("controlnet_conditioning_scale_outpaint", controlnetConditioningScaleOutpaint);
    payload.Add("control_guidance_end_inpaint", controlGuidanceEndInpaint);
    payload.Add("control_guidance_end_outpaint", controlGuidanceEndOutpaint);
    payload.Add("guidance_scale_inpaint", guidanceScaleInpaint);
    payload.Add("guidance_scale_outpaint", guidanceScaleOutpaint);


    A = payload.ToString(Newtonsoft.Json.Formatting.Indented);
# ---------- end c_script_5 ----------
panel_8 = Panel(c_script_5.A)

# ---- group: uploads images to pastebin & locally
# A output only when doIt=True
c_script_6 = CSharpScript(
    doIt=Button(),
    doSaveLocal=Toggle(True),
    localSavePath=local_savepath,
    pastebinAPIURL=pastebin_api_url_no_trailing_slash,
    pastebinPublicURL=pastebin_public_url_no_trailing_slash,
    bmpRender=c_script.A,
    bmpDepth=c_script_3.A,
    bmpSemantic=c_script_2.A,
    strJSON=c_script_5.A,
    Reference=["D:\GITHUB\STOCHASTIC_2023\230728_GHSERVER\Newtonsoft.Json.dll", "D:\GitHub\stochastic_2023\230728_ghserver\System.Net.Http.dll"])  # -> out, fname, A, B; inputs doIt: Boolean, doSaveLocal: Boolean, localSavePath: String, pastebinAPIURL: String, pastebinPublicURL: String, strJSON: String
# ---------- c_script_6: C# usings ----------
using Newtonsoft.Json;
using Newtonsoft.Json.Linq;
using System.IO;
using System.Drawing;
using System.Drawing.Imaging;

using System.Net.Http;
using System.Text;
using System.Threading.Tasks;
# ---------- c_script_6: C# ----------
    if (pastebinAPIURL != null && pastebinPublicURL != null && bmpRender != null && bmpDepth != null && bmpSemantic != null && strJSON != null){
      string timestamp = DateTime.Now.ToString("yyMMdd_HHmmss");

      var payload = JObject.Parse(strJSON); // Parse the JSON string
      System.Drawing.Bitmap bmpR = (System.Drawing.Bitmap) bmpRender;
      System.Drawing.Bitmap bmpD = (System.Drawing.Bitmap) bmpDepth;
      System.Drawing.Bitmap bmpS = (System.Drawing.Bitmap) bmpSemantic;

      // Images as Base64 strings in JSON
      // would be useful when webapp is up and running
      //tring b64Render = BitmapToBase64(bmpR);
      //string b64Depth = BitmapToBase64(bmpD);
      //string b64Semantic = BitmapToBase64(bmpS);


      if (doIt){

        // Images as URL on pastebin
        bool bolR = SendPutRequest(String.Format("{0}/{1}_render.png", pastebinAPIURL, timestamp), bmpR);
        bool bolD = SendPutRequest(String.Format("{0}/{1}_depth.png", pastebinAPIURL, timestamp), bmpD);
        bool bolS = SendPutRequest(String.Format("{0}/{1}_semantic.png", pastebinAPIURL, timestamp), bmpS);

        if (bolR && bolD && bolS){
          payload["img_render"] = String.Format("{0}/{1}_render.png", pastebinPublicURL, timestamp);
          payload["img_depth"] = String.Format("{0}/{1}_depth.png", pastebinPublicURL, timestamp);
          payload["img_semantic"] = String.Format("{0}/{1}_semantic.png", pastebinPublicURL, timestamp);
        }

        if (doSaveLocal){
          bmpR.Save(Path.Combine(localSavePath, timestamp + "_render.png"), System.Drawing.Imaging.ImageFormat.Png);
          bmpD.Save(Path.Combine(localSavePath, timestamp + "_depth.png"), System.Drawing.Imaging.ImageFormat.Png);
          bmpS.Save(Path.Combine(localSavePath, timestamp + "_semantic.png"), System.Drawing.Imaging.ImageFormat.Png);
          File.WriteAllText(Path.Combine(localSavePath, timestamp + ".json"), payload.ToString(Newtonsoft.Json.Formatting.Indented)); // Save the JSON string to the specified file
        }
        A = payload.ToString(Newtonsoft.Json.Formatting.Indented);
        fname = timestamp;
        return;
      }

      Print(String.Format("img_render once uploaded: {0}", String.Format("{0}/{1}_render.png", pastebinPublicURL, timestamp)));
      Print(String.Format("img_depth once uploaded: {0}", String.Format("{0}/{1}_depth.png", pastebinPublicURL, timestamp)));
      Print(String.Format("img_semantic once uploaded: {0}", String.Format("{0}/{1}_semantic.png", pastebinPublicURL, timestamp)));
      B = payload.ToString(Newtonsoft.Json.Formatting.Indented);
    }
# ---------- c_script_6: C# additional code ----------
  public string BitmapToBase64(Bitmap bitmap)
  {
    using (MemoryStream memory = new MemoryStream())
    {
      bitmap.Save(memory, ImageFormat.Png); // or ImageFormat.Jpeg based on your needs
      byte[] byteImage = memory.ToArray();
      return Convert.ToBase64String(byteImage);
    }
  }

  private bool SendPutRequest(string url, System.Drawing.Bitmap bitmap)
  {
    using (var client = new HttpClient())
    {
      byte[] imageBytes = BitmapToByteArray(bitmap);
      using (var content = new ByteArrayContent(imageBytes))
      {
        // Set the content type to "text/plain" as in your curl request
        content.Headers.ContentType = new System.Net.Http.Headers.MediaTypeHeaderValue("text/plain");

        HttpResponseMessage responseMessage = client.PutAsync(url, content).Result; // Force synchronous execution

        if (responseMessage.IsSuccessStatusCode)
        {
          return true;
          //return responseMessage.Content.ReadAsStringAsync().Result; // Force synchronous execution
        }
        else
        {
          throw new Exception("Request failed with status code: " + responseMessage.StatusCode.ToString());
        }
      }
    }
  }

  private byte[] BitmapToByteArray(System.Drawing.Bitmap bitmap)
  {
    using (MemoryStream memory = new MemoryStream())
    {
      bitmap.Save(memory, System.Drawing.Imaging.ImageFormat.Png);
      return memory.ToArray();
    }

  }
# ---------- end c_script_6 ----------

# ----
strjson = Text(c_script_6.A)
fname = Text(c_script_6.fname)
panel_9 = Panel(c_script_6.B)
panel_10 = Panel(c_script_6.out)
sr_collage_latest_version = Panel("b8c711cd5c10a1a27c296d81ce936cc8d8c1451e72ebd90cccf2ba1d06f44c7e")
strjson_2 = Text(strjson)
fname_2 = Text(fname)
c_script_7 = CSharpScript(
    localSavePath=local_savepath,
    fname=fname_2,
    strJSON=strjson_2,
    versionStr=sr_collage_latest_version,
    secretReplicateToken=secret_token,
    Reference=["D:\GITHUB\STOCHASTIC_2023\230728_GHSERVER\Newtonsoft.Json.dll", "D:\GitHub\stochastic_2023\230728_ghserver\System.Net.Http.dll"])  # -> out, A; inputs localSavePath: String, fname: String, strJSON: String, versionStr: String, secretReplicateToken: String
# ---------- c_script_7: C# usings ----------
using Newtonsoft.Json;
using Newtonsoft.Json.Linq;

using System.Net.Http;
using System.Text;
using System.IO;
# ---------- c_script_7: C# ----------
    int timeout = 10; // in seconds

    if (strJSON != null){

      JObject payload = constructPayload(strJSON, versionStr); // Parse the JSON string
      JObject response = MakePostRequest(payload, secretReplicateToken, timeout);

      Print(response.ToString());

      JArray urlsResultArray = (JArray) response["output"]["urls_result"];
      List<string> urlsResultList = urlsResultArray.ToObject<List<string>>();

      int fileCounter = 0;
      foreach (string url in urlsResultList)
      {
        string downloadedFilePath = DownloadImageFromUrl(url, fileCounter, localSavePath, fname);
        if (downloadedFilePath != null)
        {
          fileCounter++;
        }
      }

      if (urlsResultArray.Count > 0){
        A = urlsResultList[0];
      }
    }
# ---------- c_script_7: C# additional code ----------
  public JObject MakePostRequest(JObject payload, string apiToken, int timeout)
  {
    using (var client = new HttpClient())
    {
      // Set the Authorization header
      client.DefaultRequestHeaders.Add("Authorization", "Token " + apiToken);

      // Convert JObject payload to string
      string jsonString = payload.ToString();

      // Make the POST request and get response synchronously
      HttpResponseMessage response = client.PostAsync("https://api.replicate.com/v1/predictions",
        new StringContent(jsonString, Encoding.UTF8, "application/json")).Result;

      if (!response.IsSuccessStatusCode)
      {
        throw new Exception("Failed to make a successful request: " + response.StatusCode);
      }

      // Read and parse the JSON response
      var jsonResponse = response.Content.ReadAsStringAsync().Result;
      JObject parsedResponse = JObject.Parse(jsonResponse);

      // Extracting job id from the response
      string prediction_id = parsedResponse["id"].ToString();

      // Variables for polling timeout mechanism
      int elapsedSeconds = 0;
      int timeoutInSeconds = timeout;
      int delayInSeconds = 3; // Poll every 3 seconds

      // Polling mechanism to check the status
      while (elapsedSeconds < timeoutInSeconds)
      {
        // Wait for a few seconds before polling again
        System.Threading.Thread.Sleep(delayInSeconds * 1000); // Convert seconds to milliseconds

        string statusUrl = string.Format("https://api.replicate.com/v1/predictions/{0}", prediction_id);
        HttpResponseMessage statusResponse = client.GetAsync(statusUrl).Result;
        var statusJsonResponse = statusResponse.Content.ReadAsStringAsync().Result;
        JObject statusParsedResponse = JObject.Parse(statusJsonResponse);

        string status = statusParsedResponse["status"].ToString();

        if (status == "succeeded")
        {
          // If job is done, return the complete response
          return statusParsedResponse;
        }
        else if (status == "failed")
        {
          throw new Exception("Job failed!");
        }
        else if (status == "canceled")
        {
          throw new Exception("Job canceled!");
        }
        elapsedSeconds += delayInSeconds;
      }

      // If we reach here, the polling timed out.
      throw new Exception("Polling timed out after " + timeoutInSeconds + " seconds.");
    }
  }


  public string DownloadImageFromUrl(string url, int fileCounter, string localSavePath, string fname)
  {
    using (HttpClient httpClient = new HttpClient())
    {
      HttpResponseMessage response = httpClient.GetAsync(url).Result;
      if (response.IsSuccessStatusCode)
      {
        byte[] imageBytes = response.Content.ReadAsByteArrayAsync().Result;

        // Ensure the local save path exists
        if (!Directory.Exists(localSavePath))
        {
          Directory.CreateDirectory(localSavePath);
        }

        string filePath = Path.Combine(localSavePath, string.Format("{0}_{1}c.png", fname, fileCounter));
        File.WriteAllBytes(filePath, imageBytes);

        Console.WriteLine(String.Format("Downloaded {0} to {1}", url, filePath));
        return filePath; // Return the path to the downloaded file
      }
      else
      {
        Console.WriteLine(String.Format("Failed to download {url}", url));
        return null; // Return null if download failed
      }
    }
  }

  public JObject constructPayload(string input, string version)
  {
    // Parse the input string to JObject
    JObject inputObject = JObject.Parse(input);

    // Construct the main JObject
    JObject mainObject = new JObject
      {
        { "input", inputObject },
        { "version", version }
        };

    return mainObject;
  }
# ---------- end c_script_7 ----------
panel_11 = Panel(c_script_7.A)
panel_12 = Panel(c_script_7.out)
sr_refine_latest_version = Panel("d6802bbde76740eb107adf1793f2be2bcc81623a4fd2ce1d476786a5710869dd")
strjson_3 = Text(strjson)
fname_3 = Text(fname)
c_script_8 = CSharpScript(
    localSavePath=local_savepath,
    img_base=c_script_7.A,
    fname=fname_3,
    strJSON=strjson_3,
    versionStr=sr_refine_latest_version,
    secretReplicateToken=secret_token,
    Reference=["D:\GITHUB\STOCHASTIC_2023\230728_GHSERVER\Newtonsoft.Json.dll", "D:\GitHub\stochastic_2023\230728_ghserver\System.Net.Http.dll"])  # -> out, A; inputs localSavePath: String, img_base: String, fname: String, strJSON: String, versionStr: String, secretReplicateToken: String
# ---------- c_script_8: C# ----------
    int timeout = 10; // in seconds

    if (strJSON != null){

      JObject payload = constructPayload(strJSON, img_base, versionStr); // Parse the JSON string
      JObject response = MakePostRequest(payload, secretReplicateToken, timeout);

      Print(response.ToString());

      JArray urlsResultArray = (JArray) response["output"]["urls_result"];
      List<string> urlsResultList = urlsResultArray.ToObject<List<string>>();

      int fileCounter = 0;
      foreach (string url in urlsResultList)
      {
        string downloadedFilePath = DownloadImageFromUrl(url, fileCounter, localSavePath, fname);
        if (downloadedFilePath != null)
        {
          fileCounter++;
        }
      }

      if (urlsResultArray.Count > 0){
        A = urlsResultList[0];
      }
    }
# ---------- c_script_8: C# additional code ----------
  public JObject MakePostRequest(JObject payload, string apiToken, int timeout)
  {
    using (var client = new HttpClient())
    {
      // Set the Authorization header
      client.DefaultRequestHeaders.Add("Authorization", "Token " + apiToken);

      // Convert JObject payload to string
      string jsonString = payload.ToString();

      // Make the POST request and get response synchronously
      HttpResponseMessage response = client.PostAsync("https://api.replicate.com/v1/predictions",
        new StringContent(jsonString, Encoding.UTF8, "application/json")).Result;

      if (!response.IsSuccessStatusCode)
      {
        throw new Exception("Failed to make a successful request: " + response.StatusCode);
      }

      // Read and parse the JSON response
      var jsonResponse = response.Content.ReadAsStringAsync().Result;
      JObject parsedResponse = JObject.Parse(jsonResponse);

      // Extracting job id from the response
      string prediction_id = parsedResponse["id"].ToString();

      // Variables for polling timeout mechanism
      int elapsedSeconds = 0;
      int timeoutInSeconds = timeout;
      int delayInSeconds = 3; // Poll every 3 seconds

      // Polling mechanism to check the status
      while (elapsedSeconds < timeoutInSeconds)
      {
        // Wait for a few seconds before polling again
        System.Threading.Thread.Sleep(delayInSeconds * 1000); // Convert seconds to milliseconds

        string statusUrl = string.Format("https://api.replicate.com/v1/predictions/{0}", prediction_id);
        HttpResponseMessage statusResponse = client.GetAsync(statusUrl).Result;
        var statusJsonResponse = statusResponse.Content.ReadAsStringAsync().Result;
        JObject statusParsedResponse = JObject.Parse(statusJsonResponse);

        string status = statusParsedResponse["status"].ToString();

        if (status == "succeeded")
        {
          // If job is done, return the complete response
          return statusParsedResponse;
        }
        else if (status == "failed")
        {
          throw new Exception("Job failed!");
        }
        else if (status == "canceled")
        {
          throw new Exception("Job canceled!");
        }
        elapsedSeconds += delayInSeconds;
      }

      // If we reach here, the polling timed out.
      throw new Exception("Polling timed out after " + timeoutInSeconds + " seconds.");
    }
  }


  public string DownloadImageFromUrl(string url, int fileCounter, string localSavePath, string fname)
  {
    using (HttpClient httpClient = new HttpClient())
    {
      HttpResponseMessage response = httpClient.GetAsync(url).Result;
      if (response.IsSuccessStatusCode)
      {
        byte[] imageBytes = response.Content.ReadAsByteArrayAsync().Result;

        // Ensure the local save path exists
        if (!Directory.Exists(localSavePath))
        {
          Directory.CreateDirectory(localSavePath);
        }

        string filePath = Path.Combine(localSavePath, string.Format("{0}_{1}.png", fname, fileCounter));
        File.WriteAllBytes(filePath, imageBytes);

        Console.WriteLine(String.Format("Downloaded {0} to {1}", url, filePath));
        return filePath; // Return the path to the downloaded file
      }
      else
      {
        Console.WriteLine(String.Format("Failed to download {url}", url));
        return null; // Return null if download failed
      }
    }
  }

  public JObject constructPayload(string input, string img_base, string version)
  {
    // Parse the input string to JObject
    JObject inputObject = JObject.Parse(input);

      inputObject.Add("img_base", img_base);

      // Construct the main JObject
      JObject mainObject = new JObject
      {
        { "input", inputObject },
        { "version", version }
        };

    return mainObject;
  }
# ---------- end c_script_8 ----------
